# Grasshopper definition stress-display-throughput.gh (Grasshopper 1.0.9)
# plug-ins: Selva

# ---- group: Load / Inputs
# stress-display-throughput
# Blue: inputs to change.   Green: outputs (charts, results, values passed on).   Named parameters mark each group's inputs and outputs.
# STRESS: DISPLAY THROUGHPUT
# For developers. Scales objects, mesh density, groups and a text payload until the viewer, the wire format or the transport gives way. Each geometry kind takes a different path: meshes go as they are, breps are meshed by the plugin or Compute, curves and points have their own encoders.
# LOAD
# Objects = grid size². Faces per mesh box = 6 × density². Groups = materials and layers.
grid_size_default = Slider(20, range=1..200)
mesh_density_default = Slider(2, range=1..40)
groups_default = Slider(8, range=1..64)
geometry_options = ValueList({"Meshes", "Breps", "Curves", "Points"}, selected="Meshes")
height_variation_default = Slider(0.5, range=0..1)
seed_default = Slider(1, range=0..100)
payload_default = Slider(1, range=1..20000)
height_variation = GetNumber(height_variation_default, AtLeast=1, AtMost=1, Maximum=1, Minimum=0, Prompt="Height variation", TreeAccess=False)
mesh_density = GetInteger(mesh_density_default, AtLeast=1, AtMost=1, Maximum=40, Minimum=1, Prompt="Mesh density", TreeAccess=False)
grid_size = GetInteger(grid_size_default, AtLeast=1, AtMost=1, Maximum=200, Minimum=1, Prompt="Grid size", TreeAccess=False)
groups = GetInteger(groups_default, AtLeast=1, AtMost=1, Maximum=64, Minimum=1, Prompt="Groups", TreeAccess=False)
geometry = GetValueList(
    geometry_options,
    AtLeast=1,
    AtMost=1,
    Immediate=True,
    ListAccess=False,
    Prompt="Geometry",
    StoredItems="""[
  {
    "name": "Meshes",
    "expression": "Meshes"
  },
  {
    "name": "Breps",
    "expression": "Breps"
  },
  {
    "name": "Curves",
    "expression": "Curves"
  },
  {
    "name": "Points",
    "expression": "Points"
  }
]""",
    TreeAccess=False)
seed = GetInteger(seed_default, AtLeast=1, AtMost=1, Maximum=100, Minimum=0, Prompt="Seed", TreeAccess=False)
payload = GetInteger(payload_default, AtLeast=1, AtMost=1, Maximum=20000, Minimum=1, Prompt="Payload", TreeAccess=False)

# ---- group: UI Bridge / Inputs
toggle = BooleanToggle(False)

# ---- group: UI Bridge
uibridge = UIBridge(Enable=toggle, Schema="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")  # -> Schema, URL

# ---- group: UI Bridge / Outputs
c_bake = ContextBake(Content=uibridge.Schema)

# ---- group: Geometry / Inputs
kind_index_options = Panel("""Meshes
Breps
Curves
Points""")
kind_index_options_2 = KindIndexOptions(kind_index_options)

# ---- group: Geometry
# GEOMETRY
# A grid of boxes with random heights, then the chosen kind of geometry from them.
height_variation_2 = HeightVariation(height_variation)
grid_size_2 = GridSize(grid_size)
seed_2 = Seed(seed)
mesh_density_2 = MeshDensity(mesh_density)
geometry_2 = Geometry(geometry)
grid_x = Series(Start=0, Step=1.2, Count=grid_size_2)
grid_points = ConstructPoint(XCoordinate=graft(grid_x), YCoordinate=grid_x, ZCoordinate=0)
shortest = Evaluate(E="1-x*0.9", x=height_variation_2)
tallest = Evaluate(E="1+x*3", x=height_variation_2)
point_list = FlattenTree(Tree=grid_points, Path="{0}")
height_range = ConstructDomain(DomainStart=shortest, DomainEnd=tallest)
object_count = ListLength(List=point_list)
placing = ReportProgress(Data=point_list, Message="Placing objects…")
heights = Random(Range=height_range, Number=object_count, Seed=seed_2)
boxes = CenterBox(Base=placing, X=0.5, Y=0.5, Z=heights)
meshing = ReportProgress(Data=boxes, Message="Meshing boxes…")
geometry_name = Text(geometry_2)
kind_index = MemberIndex(Set=kind_index_options_2, Member=geometry_name)  # -> Index, Count
meshes = MeshBox(Base=meshing, XCount=mesh_density_2, YCount=mesh_density_2, ZCount=mesh_density_2)
curves = Rectangle(Plane=placing, XSize=Domain(-0.5, 0.5), YSize=Domain(-0.5, 0.5), Radius=0)  # -> Rectangle, Length
chosen_kind = StreamFilter(Gate=kind_index.Index, Stream0=meshes, Stream1=boxes, Stream2=curves.Rectangle, Stream3=placing)

# ---- group: Payload / Inputs
_1_kb_line = Panel("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")
_1_kb_line_2 = _1KBLine(_1_kb_line)

# ---- group: Payload
# PAYLOAD
# A text file of the chosen size in kB, to push the file transport and the download path.
payload_2 = Payload(payload)
lines = RepeatData(Data=_1_kb_line_2, Length=payload_2)
payload_file = CreateFile(Data=lines, Name="payload", Extension=".txt", IsBase64=False)

# ---- group: Payload / Outputs
c_bake_2 = ContextBake(PayloadTXT=payload_file)

# ---- group: Geometry / Outputs
object_count_2 = ObjectCount(object_count)
chosen_kind_2 = ChosenKind(chosen_kind)

# ---- group: Numbers
# NUMBERS
# What the viewer is about to receive, and a warning past two million faces.
mesh_density_3 = MeshDensity(mesh_density)
object_count_3 = ObjectCount(object_count_2)
faces = Evaluate(E="x*6*y^2", x=object_count_3, y=mesh_density_3)
vertices = Evaluate(E="x*6*(y+1)^2", x=object_count_3, y=mesh_density_3)
format_0_0 = Format(Format="{0:0}", Culture=127, Data0=faces)
under_2_m = SmallerThan(FirstNumber=faces, SecondNumber=2000000)  # -> SmallerThan, OrEqualTo
format_0_0_2 = Format(Format="{0:0}", Culture=127, Data0=vertices)

# ---- group: Groups
# GROUPS
# The objects split into equal groups, each with its own colour and layer: one Display branch per group.
object_count_4 = ObjectCount(object_count_2)
chosen_kind_3 = ChosenKind(chosen_kind_2)
groups_2 = Groups(groups)
group_numbers = Series(Start=0, Step=1, Count=groups_2)
group_colours = Gradient(
    LowerLimit=0,
    UpperLimit=groups_2,
    Parameter=group_numbers,
    stops=[0: RGB(243, 57, 0), 0.1: RGB(236, 27, 60), 0.2: RGB(210, 0, 118), 0.3: RGB(103, 0, 120), 0.4: RGB(39, 72, 161), 0.5: RGB(1, 192, 229), 0.6: RGB(18, 178, 90), 0.7: RGB(79, 186, 8), 0.8: RGB(220, 237, 32), 0.9: RGB(247, 159, 20), 1: RGB(243, 57, 0)])
group_size = Evaluate(E="floor((x+y-1)/y)", x=object_count_4, y=groups_2)
layer_names = Format(Format="Stress/Group {0:00}", Culture=127, Data0=group_numbers)
group_materials = ThreeMaterial(Color=group_colours, Roughness=0.6)
groups_3 = PartitionList(List=chosen_kind_3, Size=group_size)
layer_per_group = GraftTree(Tree=layer_names, IncludeEmptyLists=True, IncludeNullItems=True)
material_per_group = GraftTree(Tree=group_materials, IncludeEmptyLists=True, IncludeNullItems=True)
scene = Display(Geo=groups_3, Name="Object", Layer=layer_per_group, Material=material_per_group)

# ---- group: Numbers / Outputs
c_print = ContextPrint(MeshVertices=format_0_0_2)
c_print_2 = ContextPrint(MeshFaces=format_0_0)
c_print_3 = ContextPrint(Objects=object_count_3)
heavy_scene = Message(
    Condition=under_2_m.SmallerThan,
    Message="Over two million faces: expect a slow first frame, and a struggling phone.",
    Level=1,
    Notify=1)

# ---- group: Groups / Outputs
c_bake_3 = ContextBake(Scene=scene)
