# Grasshopper definition stress-every-input-and-output.gh (Grasshopper 1.0.9)
# plug-ins: Selva Canopy, Selva

# ---- group: Choices / Inputs
# stress-every-input-and-output
# Blue: inputs to change.   Green: outputs (charts, results, values passed on).   Named parameters mark each group's inputs and outputs.
# STRESS: EVERY INPUT AND OUTPUT
# For developers. One of each input widget, visibility rules, a dynamic value list, every output kind (text, numbers, 3D, charts, files, a folder of files), progress steps, and remarks, warnings and errors on demand. The Echo output shows exactly what the definition received.
# CHOICES
# Three value-list styles and a dynamic list whose options come from Integer.
dropdown_options = ValueList({"Alpha", "Beta", "Gamma"}, selected="Alpha")
segmented_options = ValueList({"S", "M", "L", "XL"}, selected="M")
tiles_options = ValueList({"Red", "Green", "Blue"}, selected="Blue")
gamma_note_default = Panel("Only shown for Gamma")
gamma_note = GetString(gamma_note_default, AtLeast=1, AtMost=1, Prompt="Gamma note", TreeAccess=False)
dropdown = GetValueList(
    dropdown_options,
    AtLeast=1,
    AtMost=1,
    Immediate=True,
    ListAccess=False,
    Prompt="Dropdown",
    StoredItems="""[
  {
    "name": "Alpha",
    "expression": "Alpha"
  },
  {
    "name": "Beta",
    "expression": "Beta"
  },
  {
    "name": "Gamma",
    "expression": "Gamma"
  }
]""",
    TreeAccess=False)
segmented = GetValueList(
    segmented_options,
    AtLeast=1,
    AtMost=1,
    Immediate=True,
    ListAccess=False,
    Prompt="Segmented",
    StoredItems="""[
  {
    "name": "S",
    "expression": "S"
  },
  {
    "name": "M",
    "expression": "M"
  },
  {
    "name": "L",
    "expression": "L"
  },
  {
    "name": "XL",
    "expression": "XL"
  }
]""",
    TreeAccess=False)
tiles = GetValueList(
    tiles_options,
    AtLeast=1,
    AtMost=1,
    Immediate=True,
    ListAccess=False,
    Prompt="Tiles",
    StoredItems="""[
  {
    "name": "Red",
    "expression": "Red"
  },
  {
    "name": "Green",
    "expression": "Green"
  },
  {
    "name": "Blue",
    "expression": "Blue"
  }
]""",
    TreeAccess=False)
dynamic = GetDynamicValueList(AtLeast=1, AtMost=1, Immediate=True, ListAccess=False, Prompt="Dynamic", StoredItems="[]", TreeAccess=False)

# ---- group: Basic inputs / Inputs
# BASIC INPUTS
# Number, integer, boolean and text.
number_default = Slider(42.5, range=0..100)
integer_default = Slider(5, range=1..20)
boolean_default = BooleanToggle(False)
text_default = Panel("Hello, Selva")
advanced_default = Slider(3, range=0..10)
number = GetNumber(number_default, AtLeast=1, AtMost=1, Maximum=100, Minimum=0, Prompt="Number", TreeAccess=False)
integer = GetInteger(integer_default, AtLeast=1, AtMost=1, Maximum=20, Minimum=1, Prompt="Integer", TreeAccess=False)
boolean = GetBoolean(boolean_default, AtLeast=1, AtMost=1, FalseValue="False", Prompt="Boolean", TreeAccess=False, TrueValue="True")
text = GetString(text_default, AtLeast=1, AtMost=1, Prompt="Text", TreeAccess=False)
advanced = GetNumber(advanced_default, AtLeast=1, AtMost=1, Maximum=10, Minimum=0, Prompt="Advanced", TreeAccess=False)

# ---- group: Media and messages / Inputs
# MEDIA
# Colour tints the box; an image becomes its texture; a file's name and size are echoed.
swatch = ColourSwatch(SwatchColor=RGB(230, 120, 40))
raise_options = ValueList({"Nothing", "Remark", "Warning", "Error"}, selected="Nothing")
colour = GetColor(swatch, AtLeast=1, AtMost=1, Immediate=True, Prompt="Colour", TreeAccess=False)
raise = GetValueList(
    raise_options,
    AtLeast=1,
    AtMost=1,
    Immediate=True,
    ListAccess=False,
    Prompt="Raise",
    StoredItems="""[
  {
    "name": "Nothing",
    "expression": "Nothing"
  },
  {
    "name": "Remark",
    "expression": "Remark"
  },
  {
    "name": "Warning",
    "expression": "Warning"
  },
  {
    "name": "Error",
    "expression": "Error"
  }
]""",
    TreeAccess=False)
file = GetFile(AtLeast=1, AtMost=1, Immediate=True, Prompt="Select a file to import", TreeAccess=False)
image = GetImage(AtLeast=1, AtMost=1, Immediate=True, Prompt="Select an image", TreeAccess=False)

# ---- group: UI Bridge / Inputs
toggle = BooleanToggle(False)

# ---- group: UI Bridge
uibridge = UIBridge(Enable=toggle, Schema="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")  # -> Schema, URL

# ---- group: UI Bridge / Outputs
c_bake = ContextBake(Content=uibridge.Schema)

# ---- group: Echo / Inputs
sentence = Panel("Selva wraps long outputs without breaking the layout. ")
sentence_2 = Sentence(sentence)

# ---- group: Echo
# ECHO
# Every value as the definition received it, one line each, plus a long text to test wrapping.
dropdown_2 = Dropdown(dropdown)
segmented_2 = Segmented(segmented)
tiles_2 = Tiles(tiles)
dynamic_2 = Dynamic(dynamic)
number_2 = Number(number)
integer_2 = Integer(integer)
boolean_2 = Boolean(boolean)
text_2 = Text(text)
advanced_2 = Advanced(advanced)
colour_2 = Colour(colour)
file_2 = File(file)
dropdown_name = Text(dropdown_2)
segmented_name = Text(segmented_2)
tiles_name = Text(tiles_2)
long_text = RepeatData(Data=sentence_2, Length=40)
double = Evaluate(E="x*2", x=number_2)
echo = Format(
    Format="""number = {0}
integer = {1}
boolean = {2}
text = {3}
advanced = {4}
dropdown = {5}
segmented = {6}
tiles = {7}
dynamic = {8}
colour = {9}
file = {10}""",
    Culture=127,
    Data0=number_2,
    Data1=integer_2,
    Data2=boolean_2,
    Data3=text_2,
    Data4=advanced_2,
    Data5=dropdown_name,
    Data6=segmented_name,
    Data7=tiles_name,
    Data8=dynamic_2,
    Data9=colour_2,
    Data10=file_2)
paragraph = TextJoin(Text=long_text)

# ---- group: Charts / Inputs
bar_labels = Panel("""Alpha
Beta
Gamma""")
bar_values = Panel("""3
7
5""")
bar_values_2 = BarValues(bar_values)
bar_labels_2 = BarLabels(bar_labels)

# ---- group: Charts
# CHARTS
# A bar chart, a scatter and a histogram from the same numbers.
number_3 = Number(number)
integer_3 = Integer(integer)
samples = Random(Range=Domain(0, 1), Number=400, Seed=integer_3)
t = Range(Domain=Domain(0, 6.283), Steps=60)
bars = Bar(X=bar_labels_2, Y=bar_values_2, Name="Choices", Orientation=0)
wave = Evaluate(E="sin(x*y/10)", x=t, y=number_3)
histogram = QuickChart(Data=samples, Kind=0, Title="400 random samples")
bar_figure = Figure(Traces=bars, ExportFormat="png")
wave_chart = QuickChart(Data=wave, Kind=0, Title="sin(t × Number / 10)")

# ---- group: Dynamic options
# DYNAMIC OPTIONS
# Integer sets how many options the Dynamic list offers.
integer_4 = Integer(integer)
option_numbers = Series(Start=1, Step=1, Count=integer_4)
option_pairs = Format(Format="\"Option {0}\" = {0}", Culture=127, Data0=option_numbers)
dynamic_options = SetDynamicValueList(Options=option_pairs)

# ---- group: 3D
# 3D
# A box per Integer, coloured by Colour and textured with Image when one is given.
number_4 = Number(number)
integer_5 = Integer(integer)
colour_3 = Colour(colour)
image_2 = Image(image)
box_x = Series(Start=0, Step=1.5, Count=integer_5)
box_centres = ConstructPoint(XCoordinate=box_x, YCoordinate=0, ZCoordinate=0.5)
box_half_height = Evaluate(E="x/20+0.1", x=number_4)
boxes = CenterBox(Base=box_centres, X=0.5, Y=0.5, Z=box_half_height)
box_material = ThreeMaterial(Color=colour_3, Roughness=0.4, Texture=image_2)
box_meshes = MeshBox(Base=boxes, XCount=1, YCount=1, ZCount=1)
boxes_2 = Display(Geo=box_meshes, Name="Boxes", Layer="Kitchen sink", Material=box_material)

# ---- group: Messages / Inputs
raise_index_options = Panel("""Nothing
Remark
Warning
Error""")
raise_index_options_2 = RaiseIndexOptions(raise_index_options)

# ---- group: Messages
# MESSAGES
# Raise picks a level. An error blocks every output from reaching the page.
raise_2 = Raise(raise)
raise_name = Text(raise_2)
raise_index = MemberIndex(Set=raise_index_options_2, Member=raise_name)  # -> Index, Count
remark = Equality(FirstNumber=raise_index.Index, SecondNumber=1)  # -> Equality, Inequality
warning = Equality(FirstNumber=raise_index.Index, SecondNumber=2)  # -> Equality, Inequality
error = Equality(FirstNumber=raise_index.Index, SecondNumber=3)  # -> Equality, Inequality

# ---- group: Dynamic options / Outputs
c_bake_2 = ContextBake(DynamicOptions=dynamic_options)

# ---- group: Charts / Outputs
c_bake_3 = ContextBake(Histogram=histogram)
c_bake_4 = ContextBake(Wave=wave_chart)
c_bake_5 = ContextBake(Bars=bar_figure)
t_2 = T(t)
wave_2 = Wave(wave)

# ---- group: Messages / Outputs
remark_2 = Message(Condition=remark.Inequality, Message="A test remark raised from the Raise input.", Level=0, Notify=1)
warning_2 = Message(Condition=warning.Inequality, Message="A test warning raised from the Raise input.", Level=1, Notify=1)
error_2 = Message(Condition=error.Inequality, Message="A test error raised from the Raise input.", Level=2, Notify=1)

# ---- group: 3D / Outputs
box_meshes_2 = BoxMeshes(box_meshes)
c_bake_6 = ContextBake(Scene=boxes_2)

# ---- group: Echo / Outputs
c_print = ContextPrint(Number2=double)
c_print_2 = ContextPrint(LongText=paragraph)
c_print_3 = ContextPrint(Echo=echo)
echo_2 = Echo(echo)

# ---- group: Files / Inputs
csv_header = Panel("t,value")
parts = Panel("""a
b
c""")
csv_header_2 = CSVHeader(csv_header)
parts_2 = Parts(parts)

# ---- group: Files
# FILES
# CSV, JSON, a PDF, a 3DM, and three files in nested folders: each output kind the download path handles.
t_3 = T(t_2)
wave_3 = Wave(wave_2)
echo_3 = Echo(echo_2)
text_3 = Text(text)
number_5 = Number(number)
integer_6 = Integer(integer)
box_meshes_3 = BoxMeshes(box_meshes_2)
_3dm = GeometryToFile(Geometry=box_meshes_3, LayerNames="Boxes", FileNames="boxes", FileEnding=".3dm")
csv_rows = Format(Format="{0},{1:0.0000}", Culture=127, Data0=t_3, Data1=wave_3)
body_spot = ConstructPoint(XCoordinate=0, YCoordinate=-20, ZCoordinate=0)
text_spot = ConstructPoint(XCoordinate=0, YCoordinate=0, ZCoordinate=0)
json = Format(
    Format="{{\"number\": {0}, \"integer\": {1}, \"text\": \"{2}\"}}",
    Culture=127,
    Data0=number_5,
    Data1=integer_6,
    Data2=text_3)
json_file = CreateFile(Data=json, Name="values", Extension=".json", IsBase64=False)
body = DrawText(Text=echo_3, Position=body_spot, Rotation=0, Padding=1, Radius=0)
heading = DrawText(Text=text_3, Position=text_spot, Rotation=0, Padding=1, Radius=0)
bundle_names = Format(Format="part-{0}", Culture=127, Data0=parts_2)
csv_lines = Merge(Data1=csv_header_2, Data2=csv_rows)
csv = CreateFile(Data=flatten(csv_lines), Name="wave", Extension=".csv", IsBase64=False)
bundle = CreateFile(Data=bundle_names, Name=bundle_names, Extension=".txt", IsBase64=False, SubFolder="Bundle::Parts")
report_page = Page(Drawings=[heading, body], Title="Kitchen sink report", KeepTogether=False, Arrange=0, Spacing=5)
report = Document(Pages=report_page, Title="Kitchen sink", Culture="en-US")
pdf = RenderPDF(Document=report, Name="report", AutoFit=False)

# ---- group: Files / Outputs
c_bake_7 = ContextBake(FolderOfFiles=bundle)
c_bake_8 = ContextBake(JSON=json_file)
c_bake_9 = ContextBake(_3DM=_3dm)
c_bake_10 = ContextBake(CSV=csv)
c_bake_11 = ContextBake(PDF=pdf)
