# Grasshopper definition kitchen-run.gh (Grasshopper 1.0.9)
# plug-ins: Selva

# ---- group: Kitchen / Inputs
# KITCHEN
# Layout changes the cabinets, so the form waits for its solve. Style only switches lists.
layout_options = ValueList({"Straight", "L-shaped", "Island"}, selected="Straight")
style_options = ValueList({"Shaker", "Slab", "Handleless"}, selected="Shaker")
layout = GetValueList(
    layout_options,
    AtLeast=1,
    AtMost=1,
    Immediate=True,
    ListAccess=False,
    Prompt="Layout",
    StoredItems="""[
  {
    "name": "Straight",
    "expression": "Straight"
  },
  {
    "name": "L-shaped",
    "expression": "L-shaped"
  },
  {
    "name": "Island",
    "expression": "Island"
  }
]""",
    TreeAccess=False)
style = GetValueList(
    style_options,
    AtLeast=1,
    AtMost=1,
    Immediate=True,
    ListAccess=False,
    Prompt="Style",
    StoredItems="""[
  {
    "name": "Shaker",
    "expression": "Shaker"
  },
  {
    "name": "Slab",
    "expression": "Slab"
  },
  {
    "name": "Handleless",
    "expression": "Handleless"
  }
]""",
    TreeAccess=False)

# ---- group: UI Bridge / Inputs
toggle = BooleanToggle(False)

# ---- group: UI Bridge
uibridge = UIBridge(Enable=toggle, Schema="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")  # -> Schema, URL

# ---- group: UI Bridge / Outputs
c_bake = ContextBake(Content=uibridge.Schema)

# ---- group: Cabinets / Inputs
# kitchen-run
# Blue: inputs to change.   Green: outputs (charts, results, values passed on).   Named parameters mark each group's inputs and outputs.
# KITCHEN RUN
# Options By and Repeat. The layout decides which cabinets exist, the style decides the fronts offered, and each cabinet's front decides its handles. The browser switches every list from the tables without a solve, and Grasshopper checks each pick in the solve, so every change is one solve.
cabinet_keys_straight = Panel("""back/sink
back/drawers
back/hob
back/larder""")
cabinet_keys_l_shaped = Panel("""back/sink
back/drawers
back/hob
side/drawers
side/cupboard
side/larder""")
cabinet_keys_island = Panel("""back/sink
back/drawers
back/hob
island/drawers
island/cupboard
island/shelves""")
layout_index_options = Panel("""Straight
L-shaped
Island""")
cabinet_labels_straight = Panel("""Sink
Drawers
Hob
Larder""")
cabinet_labels_l_shaped = Panel("""Sink
Drawers
Hob
Pan drawers
Cupboard
Larder""")
cabinet_labels_island = Panel("""Sink
Drawers
Hob
Pan drawers
Cupboard
Open end""")
cabinet_walls_straight = Panel("""Back wall
Back wall
Back wall
Back wall""")
cabinet_walls_l_shaped = Panel("""Back wall
Back wall
Back wall
Side wall
Side wall
Side wall""")
cabinet_walls_island = Panel("""Back wall
Back wall
Back wall
Island
Island
Island""")
cabinet_labels_l_shaped_2 = CabinetLabelsLShaped(cabinet_labels_l_shaped)
cabinet_walls_l_shaped_2 = CabinetWallsLShaped(cabinet_walls_l_shaped)
cabinet_labels_straight_2 = CabinetLabelsStraight(cabinet_labels_straight)
cabinet_keys_l_shaped_2 = CabinetKeysLShaped(cabinet_keys_l_shaped)
cabinet_walls_straight_2 = CabinetWallsStraight(cabinet_walls_straight)
cabinet_keys_straight_2 = CabinetKeysStraight(cabinet_keys_straight)
cabinet_labels_island_2 = CabinetLabelsIsland(cabinet_labels_island)
layout_index_options_2 = LayoutIndexOptions(layout_index_options)
cabinet_walls_island_2 = CabinetWallsIsland(cabinet_walls_island)
cabinet_keys_island_2 = CabinetKeysIsland(cabinet_keys_island)

# ---- group: Cabinets
# CABINETS
# Repeat's output wired into a Get Dynamic Value List shows that input once per row. Each row has a key, and a pick is stored by key, so it stays with its cabinet when the layout changes.
layout_2 = Layout(layout)
layout_name = Text(layout_2)
layout_index = MemberIndex(Set=layout_index_options_2, Member=layout_name)  # -> Index, Count
cabinet_keys = StreamFilter(Gate=layout_index.Index, Stream0=cabinet_keys_straight_2, Stream1=cabinet_keys_l_shaped_2, Stream2=cabinet_keys_island_2)
cabinet_labels = StreamFilter(
    Gate=layout_index.Index,
    Stream0=cabinet_labels_straight_2,
    Stream1=cabinet_labels_l_shaped_2,
    Stream2=cabinet_labels_island_2)
cabinet_walls = StreamFilter(
    Gate=layout_index.Index,
    Stream0=cabinet_walls_straight_2,
    Stream1=cabinet_walls_l_shaped_2,
    Stream2=cabinet_walls_island_2)
cabinets = Repeat(Keys=cabinet_keys, Labels=cabinet_labels, Section=cabinet_walls)

# ---- group: Cabinets / Outputs
cabinet_labels_2 = CabinetLabels(cabinet_labels)
c_bake_2 = ContextBake(Cabinets=cabinets)
cabinet_walls_2 = CabinetWalls(cabinet_walls)
cabinet_keys_2 = CabinetKeys(cabinet_keys)

# ---- group: Fronts / Inputs
shaker_fronts = Panel("""Shaker door
Shaker drawers
Glazed door
Open shelves""")
slab_fronts = Panel("""Slab door
Slab drawers
Open shelves""")
handleless_fronts = Panel("""Push door
Push drawers
Open shelves""")
handleless_fronts_2 = HandlelessFronts(handleless_fronts)
shaker_fronts_2 = ShakerFronts(shaker_fronts)
slab_fronts_2 = SlabFronts(slab_fronts)

# ---- group: Fronts
# FRONTS
# Options By: branch i holds the fronts for Style's i-th item. Its output wired into Fronts gives every cabinet those options; Fronts then resolves each row's pick in the same solve.
style_2 = Style(style)
front_table = Entwine(Branch00=shaker_fronts_2, Branch01=slab_fronts_2, Branch02=handleless_fronts_2, FlattenInputs=True)
fronts_by_style = OptionsBy(Options=front_table, By=style_2)
fronts = GetDynamicValueList(
    [fronts_by_style, cabinets],
    AtLeast=1,
    AtMost=1,
    Immediate=True,
    ListAccess=False,
    StoredItems="""[
  {
    "name": "Shaker door",
    "expression": "Shaker door"
  },
  {
    "name": "Shaker drawers",
    "expression": "Shaker drawers"
  },
  {
    "name": "Glazed door",
    "expression": "Glazed door"
  },
  {
    "name": "Open shelves",
    "expression": "Open shelves"
  }
]""",
    TreeAccess=False)

# ---- group: Fronts / Outputs
c_bake_3 = ContextBake(FrontOptions=fronts_by_style)

# ---- group: Handles / Inputs
drawer_handles = Panel("""Cup pull
Knob
Bar""")
push_to_open = Panel("None")
push_to_open_drawers = Panel("None")
no_front = Panel("None")
door_handles = Panel("""Knob
Bar
Edge pull""")
handle_keys = Panel("""Shaker drawers
Push door
Push drawers
Open shelves
*""")
push_to_open_drawers_2 = PushToOpenDrawers(push_to_open_drawers)
drawer_handles_2 = DrawerHandles(drawer_handles)
door_handles_2 = DoorHandles(door_handles)
push_to_open_2 = PushToOpen(push_to_open)
handle_keys_2 = HandleKeys(handle_keys)
no_front_2 = NoFront(no_front)

# ---- group: Handles
# HANDLES
# By is Fronts, itself repeated, so each cabinet reads its own resolved front. Its values aren't known up front, so Keys names them; * is every other front.
handle_table = Entwine(
    Branch00=drawer_handles_2,
    Branch01=push_to_open_2,
    Branch02=push_to_open_drawers_2,
    Branch03=no_front_2,
    Branch04=door_handles_2,
    FlattenInputs=True)
handles_by_front = OptionsBy(Options=handle_table, By=fronts, Keys=handle_keys_2)
handles = GetDynamicValueList(
    [handles_by_front, cabinets],
    AtLeast=1,
    AtMost=1,
    Immediate=True,
    ListAccess=False,
    StoredItems="""[
  {
    "name": "Knob",
    "expression": "Knob"
  },
  {
    "name": "Bar",
    "expression": "Bar"
  },
  {
    "name": "Edge pull",
    "expression": "Edge pull"
  }
]""",
    TreeAccess=False)

# ---- group: Handles / Outputs
c_bake_4 = ContextBake(HandleOptions=handles_by_front)

# ---- group: Kitchen script
# KITCHEN SCRIPT
# Builds one cabinet per row from the resolved picks. Source: Kitchen.script.cs beside the generator.
cabinet_keys_3 = CabinetKeys(cabinet_keys_2)
cabinet_walls_3 = CabinetWalls(cabinet_walls_2)
kitchen = CSharpScript(Keys=cabinet_keys_3, Sections=cabinet_walls_3, Fronts=fronts, Handles=handles)  # -> out, Carcass, Panels, Glass, Pulls, Worktop, Floor; inputs Keys: list, Sections: list, Fronts: list, Handles: list
# ---------- kitchen: C# ----------
// Grasshopper Script Instance
using System;
using System.Collections.Generic;

using Rhino.Geometry;

using Grasshopper.Kernel;

public class Script_Instance : GH_ScriptInstance
{
    // A kitchen in millimetres. Each row of the Repeat is one cabinet: Keys, Sections, Fronts and
    // Handles arrive in row order, the picks already resolved, so row i of each list is cabinet i.
    // The back wall runs along +X from the origin with its fronts to -Y, the side wall turns along -Y
    // at its right-hand end, and the island stands 1200 mm in front of it. Every front faces the
    // default camera, which looks in from -X, -Y.
    private void RunScript(List<object> Keys, List<object> Sections, List<object> Fronts, List<object> Handles,
        ref object Carcass, ref object Panels, ref object Glass, ref object Pulls, ref object Worktop, ref object Floor)
    {
        var carcass = new List<Mesh>();
        var panels = new List<Mesh>();
        var glass = new List<Mesh>();
        var pulls = new List<Mesh>();
        var worktop = new List<Mesh>();
        var run = new Dictionary<string, double>();

        double backLength = 0;
        for (int i = 0; i < Keys.Count; i++)
        {
            if (Txt(At(Sections, i)) == "Back wall") backLength += Width;
        }

        for (int i = 0; i < Keys.Count; i++)
        {
            string key = Txt(Keys[i]), section = Txt(At(Sections, i)), front = Txt(At(Fronts, i)), handle = Txt(At(Handles, i));
            bool tall = key.Contains("larder");
            double u0 = run.TryGetValue(section, out var used) ? used : 0;
            run[section] = u0 + Width;

            var cabinet = new Cabinet(Wall(section, backLength), u0, Width, tall ? 2100 : 870);
            cabinet.Carcass(carcass, open: front == "Open shelves");
            if (!tall) worktop.Add(cabinet.Box(0, Width, -20, Depth, 870, 910));
            cabinet.Fronts(front, handle, panels, glass, pulls);
        }

        // The side wall leaves the corner between the two runs: a blind cabinet under the worktop.
        if (run.ContainsKey("Side wall"))
        {
            var corner = new Cabinet(Wall("Back wall", backLength), backLength, Depth, 870);
            corner.Carcass(carcass, open: false);
            worktop.Add(corner.Box(0, Depth, -20, Depth, 870, 910));
        }

        Carcass = carcass;
        Panels = panels;
        Glass = glass;
        Pulls = pulls;
        Worktop = worktop;
        Floor = new List<Mesh> { Mesh.CreateFromBox(new BoundingBox(-1500, -3200, -20, backLength + 2100, 1200, 0), 1, 1, 1) };
    }

    const double Width = 600, Depth = 600, Plinth = 120, Gap = 3, Board = 18;

    // Origin, run direction and the direction the fronts face.
    static (Point3d Origin, Vector3d Along, Vector3d Out) Wall(string section, double backLength)
    {
        switch (section)
        {
            case "Side wall": return (new Point3d(backLength, 0, 0), -Vector3d.YAxis, -Vector3d.XAxis);
            case "Island": return (new Point3d(Width, -1200 - Depth, 0), Vector3d.XAxis, -Vector3d.YAxis);
            default: return (Point3d.Origin, Vector3d.XAxis, -Vector3d.YAxis);
        }
    }

    sealed class Cabinet
    {
        readonly (Point3d Origin, Vector3d Along, Vector3d Out) wall;
        readonly double u0, width, height;

        public Cabinet((Point3d, Vector3d, Vector3d) wall, double u0, double width, double height)
        {
            this.wall = wall; this.u0 = u0; this.width = width; this.height = height;
        }

        // u along the run, v from the front (0) to the back (Depth), z up. Negative v is in front.
        public Mesh Box(double ua, double ub, double va, double vb, double za, double zb)
        {
            var a = wall.Origin + wall.Along * (u0 + ua) - wall.Out * va + Vector3d.ZAxis * za;
            var b = wall.Origin + wall.Along * (u0 + ub) - wall.Out * vb + Vector3d.ZAxis * zb;
            return Mesh.CreateFromBox(new BoundingBox(new[] { a, b }), 1, 1, 1);
        }

        public void Carcass(List<Mesh> into, bool open)
        {
            into.Add(Box(0, Board, 0, Depth, 0, height));
            into.Add(Box(width - Board, width, 0, Depth, 0, height));
            into.Add(Box(Board, width - Board, 20, Depth, 0, Plinth));
            into.Add(Box(Board, width - Board, 0, Depth, Plinth, Plinth + Board));
            into.Add(Box(Board, width - Board, 0, Depth, height - Board, height));
            into.Add(Box(Board, width - Board, Depth - 6, Depth, Plinth, height));
            if (!open) return;
            double step = (height - Plinth) / 3;
            for (int s = 1; s < 3; s++)
            {
                double z = Plinth + s * step;
                into.Add(Box(Board, width - Board, 0, Depth - 6, z, z + Board));
            }
        }

        public void Fronts(string front, string handle, List<Mesh> panels, List<Mesh> glass, List<Mesh> pulls)
        {
            if (front == "Open shelves") return;
            bool drawers = front.EndsWith("drawers");
            int count = drawers ? (height > 1000 ? 4 : 3) : (width > 700 ? 2 : 1);
            double z0 = Plinth + Gap, z1 = height - Gap;
            for (int i = 0; i < count; i++)
            {
                double ua = drawers ? Gap : i * width / count + Gap / 2, ub = drawers ? width - Gap : (i + 1) * width / count - Gap / 2;
                double za = drawers ? z0 + i * (z1 - z0) / count + Gap / 2 : z0, zb = drawers ? z0 + (i + 1) * (z1 - z0) / count - Gap / 2 : z1;
                if (front == "Glazed door")
                {
                    Frame(panels, ua, ub, za, zb, 60, -Board, 0);
                    glass.Add(Box(ua + 60, ub - 60, -Board / 2 - 2, -Board / 2 + 2, za + 60, zb - 60));
                }
                else
                {
                    panels.Add(Box(ua, ub, -Board, 0, za, zb));
                    if (front.StartsWith("Shaker")) Frame(panels, ua, ub, za, zb, 60, -Board - 6, -Board);
                }

                // A drawer's pull is centred at its top; a door's sits by the edge that opens.
                bool right = !drawers && (count == 1 || i == 0);
                double pu = drawers ? (ua + ub) / 2 : right ? ub - 50 : ua + 50;
                double pz = drawers ? zb - 60 : (height > 1000 ? 1050 : zb - 120);
                Pull(handle, pulls, pu, pz, ua, ub, zb, drawers);
            }
        }

        void Frame(List<Mesh> into, double ua, double ub, double za, double zb, double rail, double va, double vb)
        {
            into.Add(Box(ua, ub, va, vb, za, za + rail));
            into.Add(Box(ua, ub, va, vb, zb - rail, zb));
            into.Add(Box(ua, ua + rail, va, vb, za + rail, zb - rail));
            into.Add(Box(ub - rail, ub, va, vb, za + rail, zb - rail));
        }

        void Pull(string handle, List<Mesh> into, double u, double z, double ua, double ub, double zb, bool drawers)
        {
            const double front = -Board - 6;
            switch (handle)
            {
                case "Knob":
                    var at = wall.Origin + wall.Along * (u0 + u) - wall.Out * front + Vector3d.ZAxis * z;
                    var circle = new Circle(new Plane(at, wall.Out), 14);
                    into.Add(Mesh.CreateFromCylinder(new Cylinder(circle, 24), 1, 24, true, true));
                    break;
                case "Bar":
                    if (drawers) into.Add(Box(u - 80, u + 80, front - 24, front, z - 6, z + 6));
                    else into.Add(Box(u - 6, u + 6, front - 24, front, z - 80, z + 80));
                    break;
                case "Cup pull":
                    into.Add(Box(u - 45, u + 45, front - 18, front, z - 14, z + 6));
                    break;
                case "Edge pull":
                    into.Add(Box(ua + 20, ub - 20, front - 10, front, zb - 4, zb + 8));
                    break;
            }
        }
    }

    static object At(List<object> list, int i) => i < list.Count ? list[i] : null;
    static string Txt(object o) { return o == null ? "" : o.ToString().Trim('"'); }
}
# ---------- end kitchen ----------

# ---- group: Result
# RESULT
# One line per cabinet, from the picks the solve resolved.
cabinet_labels_3 = CabinetLabels(cabinet_labels_2)
cabinet_walls_4 = CabinetWalls(cabinet_walls_2)
front_text = Text(fronts)
handle_text = Text(handles)
cabinet_line = Concatenate(
    FragmentA=cabinet_labels_3,
    FragmentB=" · ",
    FragmentC=cabinet_walls_4,
    FragmentD=": ",
    FragmentE=front_text,
    FragmentF=" / ",
    FragmentG=handle_text)
cabinet_lines = TextJoin(Text=cabinet_line)

# ---- group: Kitchen script / Outputs
kitchen_worktop = KitchenWorktop(kitchen.Worktop)
kitchen_carcass = KitchenCarcass(kitchen.Carcass)
kitchen_panels = KitchenPanels(kitchen.Panels)
kitchen_glass = KitchenGlass(kitchen.Glass)
kitchen_floor = KitchenFloor(kitchen.Floor)
kitchen_pulls = KitchenPulls(kitchen.Pulls)

# ---- group: Result / Outputs
c_print = ContextPrint(CabinetList=cabinet_lines)

# ---- group: 3D view / Inputs
style_index_options = Panel("""Shaker
Slab
Handleless""")
front_colours_data_1 = FrontColoursData1(ColourSwatch(SwatchColor=RGB(150, 168, 140)))
front_colours_data_2 = FrontColoursData2(ColourSwatch(SwatchColor=RGB(242, 240, 234)))
front_colours_data_3 = FrontColoursData3(ColourSwatch(SwatchColor=RGB(58, 60, 64)))
style_index_options_2 = StyleIndexOptions(style_index_options)
carcass_color = CarcassColor(ColourSwatch(SwatchColor=RGB(236, 232, 224)))
glass_color = GlassColor(ColourSwatch(SwatchColor=RGB(230, 240, 240)))
brass_color = BrassColor(ColourSwatch(SwatchColor=RGB(196, 160, 98)))
floor_color = FloorColor(ColourSwatch(SwatchColor=RGB(214, 210, 202)))

# ---- group: 3D view
# 3D VIEW
# One Display per part. The style picks the front colour.
kitchen_carcass_2 = KitchenCarcass(kitchen_carcass)
kitchen_panels_2 = KitchenPanels(kitchen_panels)
kitchen_glass_2 = KitchenGlass(kitchen_glass)
kitchen_pulls_2 = KitchenPulls(kitchen_pulls)
kitchen_worktop_2 = KitchenWorktop(kitchen_worktop)
kitchen_floor_2 = KitchenFloor(kitchen_floor)
style_3 = Style(style)
style_name = Text(style_3)
front_colours = Merge(Data1=front_colours_data_1, Data2=front_colours_data_2, Data3=front_colours_data_3)
style_index = MemberIndex(Set=style_index_options_2, Member=style_name)  # -> Index, Count
front_colour = ListItem(List=front_colours, Index=style_index.Index, Wrap=True)
carcass = ThreeMaterial(Color=carcass_color, Metalness=0, Roughness=0.7)
fronts_2 = ThreeMaterial(Color=front_colour, Metalness=0, Roughness=0.5)
glass = ThreeMaterial(Color=glass_color, Metalness=0, Roughness=0.05, Transmission=1)
brass = ThreeMaterial(Color=brass_color, Metalness=1, Roughness=0.3)
floor = ThreeMaterial(Color=floor_color, Metalness=0, Roughness=0.9)
worktop = MaterialPreset(Preset=23)
carcass_2 = Display(Geo=kitchen_carcass_2, Name="Carcass", Layer="Kitchen/Carcass", Material=carcass)
fronts_3 = Display(Geo=kitchen_panels_2, Name="Fronts", Layer="Kitchen/Fronts", Material=fronts_2)
glass_2 = Display(Geo=kitchen_glass_2, Name="Glass", Layer="Kitchen/Glass", Material=glass)
handles_2 = Display(Geo=kitchen_pulls_2, Name="Handles", Layer="Kitchen/Handles", Material=brass)
floor_2 = Display(Geo=kitchen_floor_2, Name="Floor", Layer="Context/Floor", Material=floor)
worktop_2 = Display(Geo=kitchen_worktop_2, Name="Worktop", Layer="Kitchen/Worktop", Material=worktop)
kitchen_2 = CombineDisplay(WebDisplay=[carcass_2, fronts_3, glass_2, handles_2, worktop_2, floor_2])

# ---- group: 3D view / Outputs
c_bake_5 = ContextBake(Kitchen=kitchen_2)
