# Grasshopper definition perforated-facade.gh (Grasshopper 1.0.9)
# plug-ins: Selva Canopy, Selva

# ---- group: Finish / Inputs
# perforated-facade
# Blue: inputs to change.   Green: outputs (charts, results, values passed on).   Named parameters mark each group's inputs and outputs.
# PERFORATED FACADE
# Metal panels whose holes grow toward an attractor. Change the pattern, the metal and the attractor, then download one DXF cut file per panel and an SVG elevation. Units: millimetres.
# FINISH
# Coated uses the colour; the others are measured metals. Backlit glows in the Night look.
metal_options = ValueList({"Corten", "Copper", "Zinc", "Coated"}, selected="Corten")
backlit_default = BooleanToggle(False)
coating_colour = GetColor(
    ColourSwatch(SwatchColor=RGB(40, 70, 64)),
    AtLeast=1,
    AtMost=1,
    Immediate=True,
    Prompt="Coating colour",
    TreeAccess=False)
metal = GetValueList(
    metal_options,
    AtLeast=1,
    AtMost=1,
    Immediate=True,
    ListAccess=False,
    Prompt="Metal",
    StoredItems="""[
  {
    "name": "Corten",
    "expression": "Corten"
  },
  {
    "name": "Copper",
    "expression": "Copper"
  },
  {
    "name": "Zinc",
    "expression": "Zinc"
  },
  {
    "name": "Coated",
    "expression": "Coated"
  }
]""",
    TreeAccess=False)
backlit = GetBoolean(backlit_default, AtLeast=1, AtMost=1, FalseValue="False", Prompt="Backlit", TreeAccess=False, TrueValue="True")

# ---- group: UI Bridge / Inputs
toggle = BooleanToggle(False)

# ---- group: Panels / Inputs
# PANELS
# A grid of panels; holes sit on a square pitch inside each one.
pattern_options = ValueList({"Circles", "Hexagons", "Squares"}, selected="Circles")
columns_default = Slider(4, range=2..8)
rows_default = Slider(2, range=1..4)
panel_width_default = Slider(1000, range=600..1500)
panel_height_default = Slider(2400, range=1500..3500)
hole_pitch_default = Slider(120, range=60..160)
pattern = GetValueList(
    pattern_options,
    AtLeast=1,
    AtMost=1,
    Immediate=True,
    ListAccess=False,
    Prompt="Pattern",
    StoredItems="""[
  {
    "name": "Circles",
    "expression": "Circles"
  },
  {
    "name": "Hexagons",
    "expression": "Hexagons"
  },
  {
    "name": "Squares",
    "expression": "Squares"
  }
]""",
    TreeAccess=False)
columns = GetInteger(columns_default, AtLeast=1, AtMost=1, Maximum=8, Minimum=2, Prompt="Columns", TreeAccess=False)
rows = GetInteger(rows_default, AtLeast=1, AtMost=1, Maximum=4, Minimum=1, Prompt="Rows", TreeAccess=False)
panel_width = GetInteger(panel_width_default, AtLeast=1, AtMost=1, Maximum=1500, Minimum=600, Prompt="Panel width", TreeAccess=False)
panel_height = GetInteger(panel_height_default, AtLeast=1, AtMost=1, Maximum=3500, Minimum=1500, Prompt="Panel height", TreeAccess=False)
hole_pitch = GetInteger(hole_pitch_default, AtLeast=1, AtMost=1, Maximum=160, Minimum=60, Prompt="Hole pitch", TreeAccess=False)

# ---- group: Attractor / Inputs
# ATTRACTOR
# Holes are largest at the attractor and shrink with distance. Invert swaps that.
attractor_x_default = Slider(30, range=0..100)
attractor_y_default = Slider(65, range=0..100)
smallest_hole_default = Slider(12, range=0..60)
largest_hole_default = Slider(88, range=40..95)
invert_default = BooleanToggle(False)
smallest_hole = GetInteger(smallest_hole_default, AtLeast=1, AtMost=1, Maximum=60, Minimum=0, Prompt="Smallest hole", TreeAccess=False)
attractor_x = GetInteger(attractor_x_default, AtLeast=1, AtMost=1, Maximum=100, Minimum=0, Prompt="Attractor X", TreeAccess=False)
attractor_y = GetInteger(attractor_y_default, AtLeast=1, AtMost=1, Maximum=100, Minimum=0, Prompt="Attractor Y", TreeAccess=False)
largest_hole = GetInteger(largest_hole_default, AtLeast=1, AtMost=1, Maximum=95, Minimum=40, Prompt="Largest hole", TreeAccess=False)
invert = GetBoolean(invert_default, AtLeast=1, AtMost=1, FalseValue="False", Prompt="Invert", TreeAccess=False, TrueValue="True")

# ---- group: UI Bridge
uibridge = UIBridge(Enable=toggle, Schema="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")  # -> Schema, URL

# ---- group: UI Bridge / Outputs
c_bake = ContextBake(Content=uibridge.Schema)

# ---- group: Panel grid
# PANEL GRID
# Panel corners on a 20 mm joint, laid out flat; the facade stands up at the end.
columns_2 = Columns(columns)
panel_width_2 = PanelWidth(panel_width)
rows_2 = Rows(rows)
panel_height_2 = PanelHeight(panel_height)
column_step = Evaluate(E="x+20", x=panel_width_2)
facade_width = Evaluate(E="x*(y+20)-20", x=columns_2, y=panel_width_2)
row_step = Evaluate(E="x+20", x=panel_height_2)
facade_height = Evaluate(E="x*(y+20)-20", x=rows_2, y=panel_height_2)
column_x = Series(Start=0, Step=column_step, Count=columns_2)
row_y = Series(Start=0, Step=row_step, Count=rows_2)
panel_corners = ConstructPoint(XCoordinate=graft(column_x), YCoordinate=row_y, ZCoordinate=0)
corner_list = FlattenTree(Tree=panel_corners, Path="{0}")
panel_outlines = Rectangle(Plane=corner_list, XSize=panel_width_2, YSize=panel_height_2, Radius=0)  # -> Rectangle, Length
one_branch_per_panel = GraftTree(Tree=panel_outlines.Rectangle, IncludeEmptyLists=True, IncludeNullItems=True)

# ---- group: Panel grid / Outputs
one_branch_per_panel_2 = OneBranchPerPanel(one_branch_per_panel)
facade_height_2 = FacadeHeight(facade_height)
facade_width_2 = FacadeWidth(facade_width)
corner_list_2 = CornerList(corner_list)

# ---- group: Holes / Inputs
sides_table = Panel("""24
6
4""")
pattern_index_options = Panel("""Circles
Hexagons
Squares""")
pattern_index_options_2 = PatternIndexOptions(pattern_index_options)
sides_table_2 = SidesTable(sides_table)

# ---- group: Holes
# HOLES
# A hole grid per panel, sized by distance to the attractor and drawn in the chosen pattern.
attractor_x_2 = AttractorX(attractor_x)
facade_width_3 = FacadeWidth(facade_width_2)
attractor_y_2 = AttractorY(attractor_y)
facade_height_3 = FacadeHeight(facade_height_2)
corner_list_3 = CornerList(corner_list_2)
hole_pitch_2 = HolePitch(hole_pitch)
panel_width_3 = PanelWidth(panel_width)
panel_height_3 = PanelHeight(panel_height)
invert_2 = Invert(invert)
largest_hole_2 = LargestHole(largest_hole)
smallest_hole_2 = SmallestHole(smallest_hole)
pattern_2 = Pattern(pattern)
margin_x = UnitX(Factor=hole_pitch_2)
margin_y = UnitY(Factor=hole_pitch_2)
margin = Addition(A=margin_x, B=margin_y)
grid_origins = Move(Geometry=corner_list_3, Motion=margin)  # -> Geometry, Transform
holes_across = Evaluate(E="floor((x-2*y)/y)", x=panel_width_3, y=hole_pitch_2)
holes_up = Evaluate(E="floor((x-2*y)/y)", x=panel_height_3, y=hole_pitch_2)
hole_grid = Square(Plane=graft(grid_origins.Geometry), Size=hole_pitch_2, ExtentX=holes_across, ExtentY=holes_up)  # -> Cells, Points
attractor_x_3 = Evaluate(E="x*y/100", x=attractor_x_2, y=facade_width_3)
attractor_y_3 = Evaluate(E="x*y/100", x=attractor_y_2, y=facade_height_3)
attractor = ConstructPoint(XCoordinate=attractor_x_3, YCoordinate=attractor_y_3, ZCoordinate=0)
holes_per_panel = TrimTree(Tree=hole_grid.Points, Depth=2)
distance = Distance(PointA=holes_per_panel, PointB=attractor)
distance_range = Bounds(Numbers=flatten(distance))
relative_distance = RemapNumbers(Value=distance, Source=distance_range, Target=Domain(0, 1))  # -> Mapped, Clipped
falloff = Evaluate(E="if(y, 1-x, x)", x=relative_distance.Mapped, y=invert_2)
hole_range = ConstructDomain(DomainStart=largest_hole_2, DomainEnd=smallest_hole_2)
pattern_name = Text(pattern_2)
pattern_index = MemberIndex(Set=pattern_index_options_2, Member=pattern_name)  # -> Index, Count
hole_share = RemapNumbers(Value=falloff, Source=Domain(0, 1), Target=hole_range)  # -> Mapped, Clipped
hole_radius = Evaluate(E="x*y/200", x=hole_share.Mapped, y=hole_pitch_2)
sides = ListItem(List=sides_table_2, Index=pattern_index.Index, Wrap=True)
holes = Polygon(Plane=holes_per_panel, Radius=hole_radius, Segments=sides, FilletRadius=0)  # -> Polygon, Length

# ---- group: Holes / Outputs
hole_radius_2 = HoleRadius(hole_radius)
holes_2 = Holes(holes.Polygon)

# ---- group: Quantities
# QUANTITIES
# Hole count, open area and sheet weight, and a chart of hole sizes.
corner_list_4 = CornerList(corner_list_2)
panel_width_4 = PanelWidth(panel_width)
panel_height_4 = PanelHeight(panel_height)
hole_radius_3 = HoleRadius(hole_radius_2)
holes_3 = Holes(holes_2)
all_holes = FlattenTree(Tree=holes_3, Path="{0}")
panel_count = ListLength(List=corner_list_4)
panel_area = Evaluate(E="x*y", x=panel_width_4, y=panel_height_4)
hole_areas = Area(Geometry=all_holes)  # -> Area, Centroid
hole_count = ListLength(List=all_holes)
diameters = Evaluate(E="2*x", x=hole_radius_3)
diameter_list = FlattenTree(Tree=diameters, Path="{0}")
sheet_area = Multiplication(A=panel_area, B=panel_count)
open_area = MassAddition(Input=hole_areas.Area)  # -> Result, PartialResults
open_area_2 = Evaluate(E="100*x/y", x=open_area.Result, y=sheet_area)
weight = Evaluate(E="(x-y)*3*7.85e-6", x=sheet_area, y=open_area.Result)
hole_chart = QuickChart(Data=diameter_list, Kind=0, Title="Hole sizes (mm)")
format_0_0_0 = Format(Format="{0:0.0}", Culture=127, Data0=open_area_2)
stiff_enough = SmallerThan(FirstNumber=open_area_2, SecondNumber=55)  # -> SmallerThan, OrEqualTo
format_0_0 = Format(Format="{0:0}", Culture=127, Data0=weight)

# ---- group: Panels
# PANELS
# Each outline with its holes becomes one punched sheet; everything rotates upright.
one_branch_per_panel_3 = OneBranchPerPanel(one_branch_per_panel_2)
holes_4 = Holes(holes_2)
facade_width_4 = FacadeWidth(facade_width_2)
facade_height_4 = FacadeHeight(facade_height_2)
cut_lines = Merge(Data1=one_branch_per_panel_3, Data2=holes_4)
wall_outline = Rectangle(Plane=PlaneXY(0, 0, 0), XSize=facade_width_4, YSize=facade_height_4, Radius=0)  # -> Rectangle, Length
trimming = ReportProgress(Data=cut_lines, Message="Punching the panels…")
light_offset = UnitZ(Factor=-120)
wall_face = BoundarySurfaces(Edges=wall_outline.Rectangle)
Z = UnitZ(Factor=-140)
light_panel = Move(Geometry=wall_face, Motion=light_offset)  # -> Geometry, Transform
wall_back = Move(Geometry=wall_face, Motion=Z)  # -> Geometry, Transform
hinge = YZPlane(Origin=Point(0, 0, 0))
pi = Pi(Factor=0.5)
sheets = BoundarySurfaces(Edges=trimming)
wall_depth = UnitZ(Factor=-300)
stand_panels = Rotate(Geometry=sheets, Angle=pi, Plane=hinge)  # -> Geometry, Transform
stand_light = Rotate(Geometry=light_panel.Geometry, Angle=pi, Plane=hinge)  # -> Geometry, Transform
wall = Extrude(Base=wall_back.Geometry, Direction=wall_depth)
stand_wall = Rotate(Geometry=wall, Angle=pi, Plane=hinge)  # -> Geometry, Transform

# ---- group: Quantities / Outputs
c_print = ContextPrint(SheetWeightKg=format_0_0)
c_print_2 = ContextPrint(OpenArea=format_0_0_0)
c_bake_2 = ContextBake(HoleSizes=hole_chart)
panel_count_2 = PanelCount(panel_count)
c_print_3 = ContextPrint(Panels=panel_count)
too_open = Message(
    Condition=stiff_enough.SmallerThan,
    Message="Over 55 % open: the sheet needs stiffeners. Shrink the largest hole or widen the pitch.",
    Level=1,
    Notify=1)
c_print_4 = ContextPrint(Holes=hole_count)

# ---- group: Panels / Outputs
stand_panels_2 = StandPanels(stand_panels.Geometry)
stand_light_2 = StandLight(stand_light.Geometry)
stand_wall_2 = StandWall(stand_wall.Geometry)
cut_lines_2 = CutLines(cut_lines)

# ---- group: 3D view / Inputs
metal_index_options = Panel("""Corten
Copper
Zinc
Coated""")
metal_preset_table = Panel("""15
5
4
6""")
metal_index_options_2 = MetalIndexOptions(metal_index_options)
metal_preset_table_2 = MetalPresetTable(metal_preset_table)
light_box_color = LightBoxColor(ColourSwatch(SwatchColor=RGB(255, 210, 150)))

# ---- group: 3D view
# 3D VIEW
# Panels in the chosen metal, a plaster wall behind, and a light box when backlit.
metal_2 = Metal(metal)
coating_colour_2 = CoatingColour(coating_colour)
backlit_2 = Backlit(backlit)
stand_panels_3 = StandPanels(stand_panels_2)
stand_light_3 = StandLight(stand_light_2)
stand_wall_3 = StandWall(stand_wall_2)
metal_name = Text(metal_2)
metal_index = MemberIndex(Set=metal_index_options_2, Member=metal_name)  # -> Index, Count
metal_preset = ListItem(List=metal_preset_table_2, Index=metal_index.Index, Wrap=True)
metal_3 = MaterialPreset(Preset=metal_preset)
coated = ThreeMaterial(Color=coating_colour_2, Base=metal_3)
light_strength = Evaluate(E="if(x, 2.5, 0)", x=backlit_2)
coated_2 = Equality(FirstNumber=metal_index.Index, SecondNumber=3)  # -> Equality, Inequality
finish = StreamFilter(Gate=coated_2.Equality, Stream0=metal_3, Stream1=coated)
light_box = EmissiveMaterial(Color=light_box_color, Strength=light_strength)
plaster = MaterialPreset(Preset=14)
panels = Display(Geo=stand_panels_3, Name="Panels", Layer="Facade/Panels", Material=finish)
light_box_2 = Display(Geo=stand_light_3, Name="Light box", Layer="Facade/Lighting", Material=light_box)
wall_2 = Display(Geo=stand_wall_3, Name="Wall", Layer="Facade/Wall", Material=plaster)
facade = CombineDisplay(WebDisplay=[panels, wall_2, light_box_2])

# ---- group: Downloads
# DOWNLOADS
# One DXF per panel in a Cut files folder, and the whole elevation as SVG.
panel_count_3 = PanelCount(panel_count_2)
cut_lines_3 = CutLines(cut_lines_2)
draw_cut_lines = DrawCurve(Curve=flatten(cut_lines_3))
panel_numbers = Series(Start=1, Step=1, Count=panel_count_3)
elevation = DrawingView(Drawings=flatten(draw_cut_lines), Length=0, Padding=5, ScaleCaption=False, Units=0)  # -> Drawings, Scale
file_names = Format(Format="panel-{0:00}", Culture=127, Data0=panel_numbers)
name_per_panel = GraftTree(Tree=flatten(file_names), IncludeEmptyLists=True, IncludeNullItems=True)
svg = RenderSVG(Document=elevation.Drawings, Name="facade-elevation", AutoFit=True, EmbedFonts=False)
cut_files = GeometryToFile(Geometry=cut_lines_3, LayerNames="Cut", FileNames=name_per_panel, FileEnding=".dxf", SubFolder="Cut files")

# ---- group: Downloads / Outputs
c_bake_3 = ContextBake(ElevationSVG=svg)
c_bake_4 = ContextBake(CutFilesDXF=cut_files)

# ---- group: 3D view / Outputs
c_bake_5 = ContextBake(Facade=facade)
