# Grasshopper definition timber-gridshell-pavilion.gh (Grasshopper 1.0.9)
# plug-ins: Selva Canopy, Selva

# ---- group: Site / Inputs
# timber-gridshell-pavilion
# Blue: inputs to change.   Green: outputs (charts, results, values passed on).   Named parameters mark each group's inputs and outputs.
# TIMBER LAMELLA PAVILION
# A timber lamella shell over a town square. Choose a form, size the shell and its lamellas, then download the drawing set, the cut list and the model. Every step is a stock or Selva component.
# SITE
# Paving for the square, an optional glass roof, and pendant lamps that light up in the viewer's Night look.
paving_options = ValueList({"Concrete", "Brick", "Limestone"}, selected="Concrete")
glass_roof_default = BooleanToggle(False)
evening_lights_default = BooleanToggle(True)
evening_lights = GetBoolean(
    evening_lights_default,
    AtLeast=1,
    AtMost=1,
    FalseValue="False",
    Prompt="Evening lights",
    TreeAccess=False,
    TrueValue="True")
paving = GetValueList(
    paving_options,
    AtLeast=1,
    AtMost=1,
    Immediate=True,
    ListAccess=False,
    Prompt="Paving",
    StoredItems="""[
  {
    "name": "Concrete",
    "expression": "Concrete"
  },
  {
    "name": "Brick",
    "expression": "Brick"
  },
  {
    "name": "Limestone",
    "expression": "Limestone"
  }
]""",
    TreeAccess=False)
glass_roof = GetBoolean(glass_roof_default, AtLeast=1, AtMost=1, FalseValue="False", Prompt="Glass roof", TreeAccess=False, TrueValue="True")

# ---- group: UI Bridge / Inputs
toggle = BooleanToggle(False)

# ---- group: Structure / Inputs
# STRUCTURE
# Two sets of glulam lamellas cut from the shell on vertical planes at 45°. Sizes in centimetres.
lamella_spacing_default = Slider(0.9, range=0.5..1.6)
lamella_depth_default = Slider(24, range=12..40)
lamella_width_default = Slider(10, range=6..16)
timber_options = ValueList({"Larch", "Walnut", "Charred"}, selected="Larch")
edge_beam_colour = GetColor(
    ColourSwatch(SwatchColor=RGB(52, 58, 62)),
    AtLeast=1,
    AtMost=1,
    Immediate=True,
    Prompt="Edge beam colour",
    TreeAccess=False)
lamella_spacing = GetNumber(lamella_spacing_default, AtLeast=1, AtMost=1, Maximum=1.6, Minimum=0.5, Prompt="Lamella spacing", TreeAccess=False)
lamella_depth = GetInteger(lamella_depth_default, AtLeast=1, AtMost=1, Maximum=40, Minimum=12, Prompt="Lamella depth", TreeAccess=False)
lamella_width = GetInteger(lamella_width_default, AtLeast=1, AtMost=1, Maximum=16, Minimum=6, Prompt="Lamella width", TreeAccess=False)
timber = GetValueList(
    timber_options,
    AtLeast=1,
    AtMost=1,
    Immediate=True,
    ListAccess=False,
    Prompt="Timber",
    StoredItems="""[
  {
    "name": "Larch",
    "expression": "Larch"
  },
  {
    "name": "Walnut",
    "expression": "Walnut"
  },
  {
    "name": "Charred",
    "expression": "Charred"
  }
]""",
    TreeAccess=False)

# ---- group: Shape / Inputs
# SHAPE
# Pillow stands on four corners with an arched opening on every side. Vault and Wave spring from the long edges.
form_options = ValueList({"Pillow", "Vault", "Wave"}, selected="Pillow")
span_default = Slider(18, range=10..30)
depth_default = Slider(13, range=8..24)
height_default = Slider(5.5, range=3..9)
openings_default = Slider(0.55, range=0..0.85)
waves_default = Slider(2, range=1..4)
form = GetValueList(
    form_options,
    AtLeast=1,
    AtMost=1,
    Immediate=True,
    ListAccess=False,
    Prompt="Form",
    StoredItems="""[
  {
    "name": "Pillow",
    "expression": "Pillow"
  },
  {
    "name": "Vault",
    "expression": "Vault"
  },
  {
    "name": "Wave",
    "expression": "Wave"
  }
]""",
    TreeAccess=False)
span = GetNumber(span_default, AtLeast=1, AtMost=1, Maximum=30, Minimum=10, Prompt="Span", TreeAccess=False)
depth = GetNumber(depth_default, AtLeast=1, AtMost=1, Maximum=24, Minimum=8, Prompt="Depth", TreeAccess=False)
height = GetNumber(height_default, AtLeast=1, AtMost=1, Maximum=9, Minimum=3, Prompt="Height", TreeAccess=False)
openings = GetNumber(openings_default, AtLeast=1, AtMost=1, Maximum=0.85, Minimum=0, Prompt="Openings", TreeAccess=False)
waves = GetInteger(waves_default, AtLeast=1, AtMost=1, Maximum=4, Minimum=1, Prompt="Waves", TreeAccess=False)

# ---- group: UI Bridge
uibridge = UIBridge(Enable=toggle, Schema="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")  # -> Schema, URL

# ---- group: UI Bridge / Outputs
c_bake = ContextBake(Content=uibridge.Schema)

# ---- group: Sheet scale and styles / Inputs
hairline_stroke_color = HairlineStrokeColor(ColourSwatch(SwatchColor=RGB(160, 160, 160)))
concrete_fill_color = ConcreteFillColor(ColourSwatch(SwatchColor=RGB(205, 205, 205)))
thin_stroke_color = ThinStrokeColor(ColourSwatch(SwatchColor=RGB(80, 80, 80)))
cut_fill_color = CutFillColor(ColourSwatch(SwatchColor=RGB(0, 0, 0)))

# ---- group: Sheet scale and styles
# SHEET SCALE
# The smallest of 1:100, 1:200 and 1:500 at which plan, section and elevation fit an A2 sheet.
span_2 = Span(span)
depth_2 = Depth(depth)
height_2 = Height(height)
medium = PathStyle(StrokeWidth=0.25)
heavy = PathStyle(StrokeWidth=0.5)
ground_hatch = PathStyle(StrokeWidth=0.25, Fill=True, HatchPattern=1)
section_line = PathStyle(StrokeWidth=0.25, DashPattern=[8, 1.5, 1, 1.5])
view_title = TextStyle(FontSize=4, Weight=1)
section_tag = TextStyle(FontSize=4, Weight=1, HorizontalAnchor=1)
lamella_number = TextStyle(FontSize=1.6, HorizontalAnchor=1, VerticalAnchor=1)
note_text = TextStyle()
addition = Addition(A=span_2, B=depth_2)
addition_2 = Addition(A=depth_2, B=height_2)
hairline = PathStyle(StrokeColor=hairline_stroke_color, StrokeWidth=0.09)
thin = PathStyle(StrokeColor=thin_stroke_color, StrokeWidth=0.13)
cut = PathStyle(StrokeWidth=0.13, FillColor=cut_fill_color, Fill=True)
concrete = PathStyle(StrokeWidth=0.25, FillColor=concrete_fill_color, Fill=True)
width_needs_1 = Evaluate(E="(x+10)*1000/520", x=addition)
height_needs_1 = Evaluate(E="(x+5.2)*1000/270", x=addition_2)
max = Maximum(A=width_needs_1, B=height_needs_1)
longest_side = Maximum(A=span_2, B=depth_2)
scale_1 = Evaluate(E="if(x<=100,100,if(x<=200,200,500))", x=max)
section_length_mm = Evaluate(E="(x+5)*1000/y", x=span_2, y=scale_1)
plan_length_mm = Evaluate(E="(x+5)*1000/y", x=longest_side, y=scale_1)
scale_text = Format(Format="1:{0}", Culture=127, Data0=scale_1)
axo_length_mm = Evaluate(E="(x+5)*1150/y", x=depth_2, y=scale_1)
end_length_mm = Evaluate(E="(x+5)*1000/y", x=depth_2, y=scale_1)

# ---- group: Shell / Inputs
form_index_options = Panel("""Pillow
Vault
Wave""")
form_index_options_2 = FormIndexOptions(form_index_options)

# ---- group: Shell
# SHELL
# The height at (u, v) is the chosen form's function times the height. Pillow blends a dome (both arches) with the edge arches by Openings.
form_2 = Form(form)
span_3 = Span(span)
depth_3 = Depth(depth)
height_3 = Height(height)
openings_2 = Openings(openings)
waves_2 = Waves(waves)
u = Range(Domain=Domain(0, 1), Steps=32)
v = Range(Domain=Domain(0, 1), Steps=24)
edge_arches = Evaluate(E="sin(pi*x)+sin(pi*y)-2*sin(pi*x)*sin(pi*y)", x=graft(u), y=v)
form_name = Text(form_2)
dome = Evaluate(E="sin(pi*x)*sin(pi*y)", x=graft(u), y=v)
opening_lift = Multiplication(A=edge_arches, B=openings_2)
crests = Multiplication(A=u, B=waves_2)
vault = Evaluate(E="sin(pi*y)+0*x", x=graft(u), y=v)
wave = Evaluate(E="sin(pi*y)*(0.72+0.28*cos(2*pi*x))", x=graft(crests), y=v)
form_index = MemberIndex(Set=form_index_options_2, Member=form_name)  # -> Index, Count
pillow = Addition(A=dome, B=opening_lift)
chosen_form = StreamFilter(Gate=form_index.Index, Stream0=pillow, Stream1=vault, Stream2=wave)
z = Multiplication(A=chosen_form, B=height_3)
x_along_span = Evaluate(E="(x-0.5)*y", x=u, y=span_3)
y_across_depth = Evaluate(E="(x-0.5)*y", x=v, y=depth_3)
shell_points = ConstructPoint(XCoordinate=graft(x_along_span), YCoordinate=y_across_depth, ZCoordinate=z)
arches = Interpolate(Vertices=shell_points, Degree=3, Periodic=False, KnotStyle=1)  # -> Curve, Length, Domain
shell = Loft(
    Curves=flatten(arches.Curve),
    Options={Adjust=False, Closed=False, LoftEnds=0, LoftSimp=0, LoftType=0, Rebuild=10, Refit=0.01})
shaping_the_shell = ReportProgress(Data=shell, Message="Shaping the shell…")

# ---- group: Sheet scale and styles / Outputs
section_length_mm_2 = SectionLengthMm(section_length_mm)
plan_length_mm_2 = PlanLengthMm(plan_length_mm)
end_length_mm_2 = EndLengthMm(end_length_mm)
axo_length_mm_2 = AxoLengthMm(axo_length_mm)
lamella_number_2 = LamellaNumber(lamella_number)
ground_hatch_2 = GroundHatch(ground_hatch)
section_line_2 = SectionLine(section_line)
section_tag_2 = SectionTag(section_tag)
scale_text_2 = ScaleText(scale_text)
view_title_2 = ViewTitle(view_title)
note_text_2 = NoteText(note_text)
concrete_2 = Concrete(concrete)
medium_2 = Medium(medium)
cut_2 = Cut(cut)
heavy_2 = Heavy(heavy)
thin_2 = Thin(thin)
hairline_2 = Hairline(hairline)
scale_1_2 = Scale1(scale_1)

# ---- group: Shell / Outputs
shaping_the_shell_2 = ShapingTheShell(shaping_the_shell)

# ---- group: Lamellas
# LAMELLAS
# Contours on vertical planes at ±45°. Each is extruded down by the lamella depth, then sideways by its width. Offcuts shorter than 60 cm are dropped.
lamella_depth_2 = LamellaDepth(lamella_depth)
lamella_width_2 = LamellaWidth(lamella_width)
shaping_the_shell_3 = ShapingTheShell(shaping_the_shell_2)
cutting_lamellas = ReportProgress(Data=shaping_the_shell_3, Message="Cutting lamellas…")
depth_m = Evaluate(E="x/100", x=lamella_depth_2)
width_m = Evaluate(E="x/100", x=lamella_width_2)
neg = Negative(Value=depth_m)
down = UnitZ(Factor=neg)

# ---- group: Lamellas / Outputs
cutting_lamellas_2 = CuttingLamellas(cutting_lamellas)
depth_m_2 = DepthM(depth_m)
width_m_2 = WidthM(width_m)
down_2 = Down(down)

# ---- group: Lamella set A
# SET A
# Lamellas running south-west to north-east.
lamella_spacing_2 = LamellaSpacing(lamella_spacing)
cutting_lamellas_3 = CuttingLamellas(cutting_lamellas_2)
down_3 = Down(down_2)
width_m_3 = WidthM(width_m_2)
set_a_direction = VectorXYZ(XComponent=1, YComponent=1, ZComponent=0)  # -> Vector, Length
set_a = Contour(Shape=cutting_lamellas_3, Point=Point(0, 0, 0), Direction=set_a_direction.Vector, Distance=lamella_spacing_2)
set_a_list = FlattenTree(Tree=set_a, Path="{0}")
set_a_lengths = Length(Curve=set_a_list)
larger = LargerThan(FirstNumber=set_a_lengths, SecondNumber=0.6)  # -> LargerThan, OrEqualTo
set_a_trimmed = Dispatch(List=set_a_list, DispatchPattern=larger.LargerThan)  # -> ListA, ListB
set_a_cut_lengths = Length(Curve=set_a_trimmed.ListA)
set_a_ribbons = Extrude(Base=set_a_trimmed.ListA, Direction=down_3)
set_a_width = Amplitude(Vector=set_a_direction.Vector, Amplitude=width_m_3)
set_a_boards = Extrude(Base=set_a_ribbons, Direction=set_a_width)

# ---- group: Lamella set B
# SET B
# Lamellas running north-west to south-east.
cutting_lamellas_4 = CuttingLamellas(cutting_lamellas_2)
lamella_spacing_3 = LamellaSpacing(lamella_spacing)
down_4 = Down(down_2)
width_m_4 = WidthM(width_m_2)
set_b_direction = VectorXYZ(XComponent=1, YComponent=-1, ZComponent=0)  # -> Vector, Length
set_b = Contour(Shape=cutting_lamellas_4, Point=Point(0, 0, 0), Direction=set_b_direction.Vector, Distance=lamella_spacing_3)
set_b_list = FlattenTree(Tree=set_b, Path="{0}")
set_b_lengths = Length(Curve=set_b_list)
larger_2 = LargerThan(FirstNumber=set_b_lengths, SecondNumber=0.6)  # -> LargerThan, OrEqualTo
set_b_trimmed = Dispatch(List=set_b_list, DispatchPattern=larger_2.LargerThan)  # -> ListA, ListB
set_b_cut_lengths = Length(Curve=set_b_trimmed.ListA)
set_b_ribbons = Extrude(Base=set_b_trimmed.ListA, Direction=down_4)
set_b_width = Amplitude(Vector=set_b_direction.Vector, Amplitude=width_m_4)
set_b_boards = Extrude(Base=set_b_ribbons, Direction=set_b_width)

# ---- group: Structure and site / Inputs
lamp_stations_along = Panel("""-0.25
0
0.25""")
lamp_stations_across = Panel("""-0.18
0.18""")
lamp_stations_across_2 = LampStationsAcross(lamp_stations_across)
lamp_stations_along_2 = LampStationsAlong(lamp_stations_along)

# ---- group: Structure and site
# STRUCTURE AND SITE
# Edge beams on the shell's free edges, concrete footings at the corners, the square, two benches and six pendant lamps hung from the shell.
depth_m_3 = DepthM(depth_m_2)
shaping_the_shell_4 = ShapingTheShell(shaping_the_shell_2)
span_4 = Span(span)
depth_4 = Depth(depth)
free_edges = BrepEdges(Brep=shaping_the_shell_4)  # -> Naked, Interior, NonManifold
Z = UnitZ(Factor=0.04)
beam_radius = Evaluate(E="x*0.4", x=depth_m_3)
half_span = Evaluate(E="x/2", x=span_4)
half_depth = Evaluate(E="x/2", x=depth_4)
bench_offset = Evaluate(E="x*0.2", x=depth_4)
bench_half_length = Evaluate(E="x*0.17", x=span_4)
glass_roof_2 = Move(Geometry=shaping_the_shell_4, Motion=Z)  # -> Geometry, Transform
square_centre = ConstructPoint(XCoordinate=0, YCoordinate=0, ZCoordinate=-0.1)
multiplication = Multiplication(A=lamp_stations_along_2, B=span_4)
multiplication_2 = Multiplication(A=lamp_stations_across_2, B=depth_4)
square_half_length = Evaluate(E="x/2+2.5", x=span_4)
square_half_width = Evaluate(E="x/2+2.5", x=depth_4)
lamp_floor_points = ConstructPoint(XCoordinate=multiplication, YCoordinate=graft(multiplication_2), ZCoordinate=0)
edge_beams = Pipe(Curve=free_edges.Naked, Radius=beam_radius, Caps=1, FitRail=False)
cord_drop = Evaluate(E="-(x+1.2)", x=depth_m_3)
neg_2 = Negative(Value=half_span)
neg_3 = Negative(Value=half_depth)
neg_4 = Negative(Value=bench_offset)
square = CenterBox(Base=square_centre, X=square_half_length, Y=square_half_width, Z=0.1)
Z_2 = UnitZ(Factor=1)
hanging_points = ProjectPoint(Point=flatten(lamp_floor_points), Direction=Z_2, Geometry=shaping_the_shell_4)  # -> Point, Index
merge = Merge(Data1=neg_4, Data2=bench_offset)
corner_x = Merge(Data1=neg_2, Data2=half_span)
corner_y = Merge(Data1=neg_3, Data2=half_depth)
neg_5 = Negative(Value=bench_half_length)
cord = UnitZ(Factor=cord_drop)
corners = ConstructPoint(XCoordinate=corner_x, YCoordinate=graft(corner_y), ZCoordinate=0)
lamps = Move(Geometry=hanging_points.Point, Motion=cord)  # -> Geometry, Transform
bench_centres = ConstructPoint(XCoordinate=0, YCoordinate=merge, ZCoordinate=0)
dom = ConstructDomain(DomainStart=neg_5, DomainEnd=bench_half_length)
dom_2 = ConstructDomain(DomainStart=-0.25, DomainEnd=0.25)
footings = Cylinder(Base=flatten(corners), Radius=0.35, Length=0.45)
bulbs = Sphere(Base=lamps.Geometry, Radius=0.17)
cord_lines = Line(StartPoint=hanging_points.Point, EndPoint=lamps.Geometry)
bench_outlines = Rectangle(Plane=bench_centres, XSize=dom, YSize=dom_2, Radius=0)  # -> Rectangle, Length
Z_3 = UnitZ(Factor=0.45)
cords = Pipe(Curve=cord_lines, Radius=0.01, Caps=0, FitRail=False)
extr = Extrude(Base=bench_outlines.Rectangle, Direction=Z_3)
benches = CapHoles(Brep=extr)

# ---- group: Lamella set A / Outputs
set_a_cut_lengths_2 = SetACutLengths(set_a_cut_lengths)
set_a_trimmed_2 = SetATrimmed(set_a_trimmed.ListA)
set_a_boards_2 = SetABoards(set_a_boards)

# ---- group: Lamella set B / Outputs
set_b_cut_lengths_2 = SetBCutLengths(set_b_cut_lengths)
set_b_trimmed_2 = SetBTrimmed(set_b_trimmed.ListA)
set_b_boards_2 = SetBBoards(set_b_boards)

# ---- group: Structure and site / Outputs
bench_half_length_2 = BenchHalfLength(bench_half_length)
hanging_points_2 = HangingPoints(hanging_points.Point)
bench_outlines_2 = BenchOutlines(bench_outlines.Rectangle)
bench_offset_2 = BenchOffset(bench_offset)
beam_radius_2 = BeamRadius(beam_radius)
edge_beams_2 = EdgeBeams(edge_beams)
free_edges_2 = FreeEdges(free_edges.Naked)
half_depth_2 = HalfDepth(half_depth)
glass_roof_3 = GlassRoof(glass_roof_2.Geometry)
half_span_2 = HalfSpan(half_span)
footings_2 = Footings(footings)
benches_2 = Benches(benches)
corners_2 = Corners(corners)
square_2 = Square(square)
bulbs_2 = Bulbs(bulbs)
cords_2 = Cords(cords)
lamps_2 = Lamps(lamps.Geometry)

# ---- group: Both sets
# BOTH SETS
# Boards for the 3D view and the model; centre lines and lengths for the drawings, quantities and cut list.
set_a_boards_3 = SetABoards(set_a_boards_2)
set_a_trimmed_3 = SetATrimmed(set_a_trimmed_2)
set_a_cut_lengths_3 = SetACutLengths(set_a_cut_lengths_2)
set_b_boards_3 = SetBBoards(set_b_boards_2)
set_b_trimmed_3 = SetBTrimmed(set_b_trimmed_2)
set_b_cut_lengths_3 = SetBCutLengths(set_b_cut_lengths_2)
all_boards = Merge(Data1=set_a_boards_3, Data2=set_b_boards_3)
all_lamella_lines = Merge(Data1=set_a_trimmed_3, Data2=set_b_trimmed_3)
all_lengths = Merge(Data1=set_a_cut_lengths_3, Data2=set_b_cut_lengths_3)

# ---- group: Both sets / Outputs
all_lamella_lines_2 = AllLamellaLines(all_lamella_lines)
all_lengths_2 = AllLengths(all_lengths)
all_boards_2 = AllBoards(all_boards)

# ---- group: 3D view / Inputs
timber_index_options = Panel("""Larch
Walnut
Charred""")
paving_preset_table = Panel("""8
13
14""")
paving_index_options = Panel("""Concrete
Brick
Limestone""")
timber_index_options_2 = TimberIndexOptions(timber_index_options)
paving_index_options_2 = PavingIndexOptions(paving_index_options)
paving_preset_table_2 = PavingPresetTable(paving_preset_table)
lamp_light_color = LampLightColor(ColourSwatch(SwatchColor=RGB(255, 190, 120)))
charred_color = CharredColor(ColourSwatch(SwatchColor=RGB(38, 33, 30)))

# ---- group: 3D view
# 3D VIEW
# One Display per part, each on its own layer. The glass roof is always there: switched off it takes an invisible material. Glass keeps its reflections at any opacity, so an opacity of 0 would still show it.
paving_2 = Paving(paving)
glass_roof_4 = GlassRoof(glass_roof)
evening_lights_2 = EveningLights(evening_lights)
timber_2 = Timber(timber)
edge_beam_colour_2 = EdgeBeamColour(edge_beam_colour)
all_boards_3 = AllBoards(all_boards_2)
glass_roof_5 = GlassRoof(glass_roof_3)
square_3 = Square(square_2)
bulbs_3 = Bulbs(bulbs_2)
cords_3 = Cords(cords_2)
benches_3 = Benches(benches_2)
footings_3 = Footings(footings_2)
edge_beams_3 = EdgeBeams(edge_beams_2)
wood = MaterialPreset(Preset=7)
paving_name = Text(paving_2)
timber_name = Text(timber_2)
paving_index = MemberIndex(Set=paving_index_options_2, Member=paving_name)  # -> Index, Count
invisible = ThreeMaterial(Opacity=0, Transparent=True)
charred = ThreeMaterial(Color=charred_color, Roughness=0.85, Base=wood)
glass_preset = MaterialPreset(Preset=9)
larch = MaterialPreset(Preset=7)
walnut = MaterialPreset(Preset=12)
glass_choices = Merge(Data1=invisible, Data2=glass_preset)
timbers = Merge(Data1=larch, Data2=walnut, Data3=charred)
paving_preset = ListItem(List=paving_preset_table_2, Index=paving_index.Index, Wrap=True)
lamp_strength = Evaluate(E="if(x,6,0)", x=evening_lights_2)
timber_index = MemberIndex(Set=timber_index_options_2, Member=timber_name)  # -> Index, Count
glass_shown = Evaluate(E="if(x,1,0)", x=glass_roof_4)
glass = ListItem(List=glass_choices, Index=glass_shown, Wrap=True)
timber_3 = ListItem(List=timbers, Index=timber_index.Index, Wrap=True)
paving_3 = MaterialPreset(Preset=paving_preset)
lamp_light = EmissiveMaterial(Color=lamp_light_color, Strength=lamp_strength)
concrete_3 = MaterialPreset(Preset=8)
beam_finish = ThreeMaterial(Color=edge_beam_colour_2, Metalness=0.6, Roughness=0.35)
cord_2 = MaterialPreset(Preset=6)
edge_beams_4 = Display(Geo=flatten(edge_beams_3), Name="Edge beams", Layer="Structure/Edge beams", Material=beam_finish)
cords_4 = Display(Geo=flatten(cords_3), Name="Cords", Layer="Lighting/Cords", Material=cord_2)
glass_roof_6 = Display(Geo=glass_roof_5, Name="Glass roof", Layer="Shell/Glass", Material=glass)
lamellas = Display(Geo=all_boards_3, Name="Lamellas", Layer="Shell/Lamellas", Material=timber_3)
square_4 = Display(Geo=square_3, Name="Square", Layer="Site/Square", Material=paving_3)
benches_4 = Display(Geo=benches_3, Name="Benches", Layer="Site/Benches", Material=timber_3)
lamps_3 = Display(Geo=bulbs_3, Name="Lamps", Layer="Lighting/Lamps", Material=lamp_light)
footings_4 = Display(Geo=footings_3, Name="Footings", Layer="Structure/Footings", Material=concrete_3)
pavilion = CombineDisplay(WebDisplay=[lamellas, glass_roof_6, edge_beams_4, footings_4, square_4, benches_4, lamps_3, cords_4])

# ---- group: Plan
# PLAN
# Lamella centre lines, edge beams, footings, benches and lamps, the square, and the section line A–A.
corners_3 = Corners(corners_2)
all_lamella_lines_3 = AllLamellaLines(all_lamella_lines_2)
free_edges_3 = FreeEdges(free_edges_2)
medium_3 = Medium(medium_2)
heavy_3 = Heavy(heavy_2)
concrete_4 = Concrete(concrete_2)
bench_outlines_3 = BenchOutlines(bench_outlines_2)
thin_3 = Thin(thin_2)
half_depth_3 = HalfDepth(half_depth_2)
half_span_3 = HalfSpan(half_span_2)
lamps_4 = Lamps(lamps_2)
section_tag_3 = SectionTag(section_tag_2)
section_line_3 = SectionLine(section_line_2)
span_5 = Span(span)
scale_1_3 = Scale1(scale_1_2)
depth_5 = Depth(depth)
plan_length_mm_3 = PlanLengthMm(plan_length_mm_2)
footing_circles = Circle(Plane=flatten(corners_3), Radius=0.35)
square_half_length_2 = Evaluate(E="x+2.5", x=half_span_3)
square_half_width_2 = Evaluate(E="x+2.5", x=half_depth_3)
section_line_end = Evaluate(E="x+1.5", x=half_span_3)
neg_6 = Negative(Value=square_half_length_2)
neg_7 = Negative(Value=square_half_width_2)
tag_x = Evaluate(E="x+0.9", x=half_span_3)
neg_8 = Negative(Value=section_line_end)
neg_9 = Negative(Value=half_depth_3)
neg_10 = Negative(Value=half_depth_3)
neg_11 = Negative(Value=tag_x)
span_dimension_mm = Evaluate(E="x*1000", x=span_5)
depth_dimension_mm = Evaluate(E="x*1000", x=depth_5)
cut_start = ConstructPoint(XCoordinate=neg_8, YCoordinate=0, ZCoordinate=0)
cut_end = ConstructPoint(XCoordinate=section_line_end, YCoordinate=0, ZCoordinate=0)
xy = XYPlane(Origin=Point(0, 0, 0))
dom_3 = ConstructDomain(DomainStart=neg_6, DomainEnd=square_half_length_2)
dom_4 = ConstructDomain(DomainStart=neg_7, DomainEnd=square_half_width_2)
neg_12 = Negative(Value=half_depth_3)
neg_13 = Negative(Value=half_span_3)
square_outline = Rectangle(Plane=xy, XSize=dom_3, YSize=dom_4, Radius=0)  # -> Rectangle, Length
sw_corner = ConstructPoint(XCoordinate=neg_13, YCoordinate=neg_12, ZCoordinate=0)
se_corner = ConstructPoint(XCoordinate=half_span_3, YCoordinate=neg_9, ZCoordinate=0)
tag_left = ConstructPoint(XCoordinate=neg_11, YCoordinate=0.5, ZCoordinate=0)
se_corner_2 = ConstructPoint(XCoordinate=half_span_3, YCoordinate=neg_10, ZCoordinate=0)
ne_corner = ConstructPoint(XCoordinate=half_span_3, YCoordinate=half_depth_3, ZCoordinate=0)
tag_right = ConstructPoint(XCoordinate=tag_x, YCoordinate=0.5, ZCoordinate=0)
lamp_circles = Circle(Plane=lamps_4, Radius=0.17)
section_line_4 = Line(StartPoint=cut_start, EndPoint=cut_end)
span_dimension_label = Format(Format="{0:0}", Culture=127, Data0=span_dimension_mm)
dimension_offset_mm = Evaluate(E="-(2.5*1000/x+8)", x=scale_1_3)
depth_dimension_label = Format(Format="{0:0}", Culture=127, Data0=depth_dimension_mm)
tag_a_left = DrawText(Text="A", Position=tag_left, Style=section_tag_3, Rotation=0, Padding=1, Radius=0)
tag_a_right = DrawText(Text="A", Position=tag_right, Style=section_tag_3, Rotation=0, Padding=1, Radius=0)
span_dimension = LinearDimension(PointA=sw_corner, PointB=se_corner, Offset=dimension_offset_mm, Label=span_dimension_label)
depth_dimension = LinearDimension(PointA=se_corner_2, PointB=ne_corner, Offset=dimension_offset_mm, Label=depth_dimension_label)
draw_footings = DrawCurve(Curve=footing_circles, Style=concrete_4)
draw_square = DrawCurve(Curve=square_outline.Rectangle, Style=medium_3)
draw_edge_beams = DrawCurve(Curve=free_edges_3, Style=heavy_3)
draw_lamellas = DrawCurve(Curve=all_lamella_lines_3, Style=thin_3)
draw_benches = DrawCurve(Curve=bench_outlines_3, Style=medium_3)
draw_lamps = DrawCurve(Curve=lamp_circles, Style=thin_3)
draw_section_line = DrawCurve(Curve=section_line_4, Style=section_line_3)
plan_view_drawings = Merge(
    Data1=draw_square,
    Data2=draw_lamellas,
    Data3=draw_edge_beams,
    Data4=draw_footings,
    Data5=draw_benches,
    Data6=draw_lamps,
    Data7=draw_section_line,
    Data8=tag_a_left,
    Data9=tag_a_right,
    Data10=span_dimension,
    Data11=depth_dimension)
plan_view = DrawingView(Drawings=flatten(plan_view_drawings), Length=plan_length_mm_3, Padding=4, ScaleCaption=False, Units=1)  # -> Drawings, Scale

# ---- group: Quantities / Inputs
length_histogram_color = LengthHistogramColor(ColourSwatch(SwatchColor=RGB(166, 123, 80)))

# ---- group: Quantities
# QUANTITIES AND CHECKS
# Timber volume, stored carbon (0.9 t CO₂e per m³ of timber) and a rough cost. Warns when the shell is shallow or a lamella is too long to transport.
all_lengths_3 = AllLengths(all_lengths_2)
depth_m_4 = DepthM(depth_m_2)
width_m_5 = WidthM(width_m_2)
shaping_the_shell_5 = ShapingTheShell(shaping_the_shell_2)
height_4 = Height(height)
depth_6 = Depth(depth)
lamella_count = ListLength(List=all_lengths_3)
sorted_lengths = SortList(Keys=all_lengths_3)  # -> Keys, ValuesA
shell_area = Area(Geometry=shaping_the_shell_5)  # -> Area, Centroid
section_area = Multiplication(A=depth_m_4, B=width_m_5)
total_length = MassAddition(Input=all_lengths_3)  # -> Result, PartialResults
format_0_0 = Format(Format="{0:0}", Culture=127, Data0=total_length.Result)
longest_lamella = ListItem(List=sorted_lengths.Keys, Index=-1, Wrap=True)
format_0_0_2 = Format(Format="{0:0}", Culture=127, Data0=shell_area.Area)
rise_over_depth = Evaluate(E="x/y", x=height_4, y=depth_6)
length_histogram = Histogram(X=all_lengths_3, Bins=12, Color=length_histogram_color, Norm=0)
layout = Layout(Title="Lamella lengths (m)", Width=0, Height=0)
timber_volume = Multiplication(A=total_length.Result, B=section_area)
lengths_chart = Figure(Traces=length_histogram, Layout=layout, ExportFormat="png")
transportable = SmallerThan(FirstNumber=longest_lamella, SecondNumber=24)  # -> SmallerThan, OrEqualTo
deep_enough = LargerThan(FirstNumber=rise_over_depth, SecondNumber=0.25)  # -> LargerThan, OrEqualTo
stored_carbon = Evaluate(E="x*0.9", x=timber_volume)
format_0_0_0 = Format(Format="{0:0.0}", Culture=127, Data0=timber_volume)
format_0_0_00 = Format(Format="{0:0.00}", Culture=127, Data0=longest_lamella)
cost_estimate = Evaluate(E="x*2400+y*140", x=timber_volume, y=shell_area.Area)
format_0_0_0_2 = Format(Format="{0:0.0}", Culture=127, Data0=stored_carbon)
format_0_0_3 = Format(Format="{0:#,0}", Culture=127, Data0=cost_estimate)

# ---- group: Downloads / Inputs
csv_header = Panel("Lamella,Set,Length (m),Width (mm),Depth (mm)")
csv_header_2 = CSVHeader(csv_header)

# ---- group: Downloads
# DOWNLOADS
# A cut list with one row per lamella, and the whole pavilion as a Rhino model.
set_a_cut_lengths_4 = SetACutLengths(set_a_cut_lengths_2)
lamella_width_3 = LamellaWidth(lamella_width)
set_b_cut_lengths_4 = SetBCutLengths(set_b_cut_lengths_2)
lamella_depth_3 = LamellaDepth(lamella_depth)
all_boards_4 = AllBoards(all_boards_2)
edge_beams_5 = EdgeBeams(edge_beams_2)
footings_5 = Footings(footings_2)
benches_5 = Benches(benches_2)
model_parts = Merge(Data1=all_boards_4, Data2=edge_beams_5, Data3=footings_5, Data4=benches_5)
lng = ListLength(List=set_a_cut_lengths_4)
lng_2 = ListLength(List=set_b_cut_lengths_4)
model = GeometryToFile(Geometry=flatten(model_parts), LayerNames="Pavilion", FileNames="lamella-pavilion", FileEnding=".3dm")
set_a_numbers = Series(Start=1, Step=1, Count=lng)
multiplication_3 = Multiplication(A=lamella_width_3, B=10)
multiplication_4 = Multiplication(A=lamella_width_3, B=10)
set_b_numbers = Series(Start=1, Step=1, Count=lng_2)
multiplication_5 = Multiplication(A=lamella_depth_3, B=10)
multiplication_6 = Multiplication(A=lamella_depth_3, B=10)
set_a_rows = Format(
    Format="A{0:00},A,{1:0.000},{2:0},{3:0}",
    Culture=127,
    Data0=set_a_numbers,
    Data1=set_a_cut_lengths_4,
    Data2=multiplication_3,
    Data3=multiplication_5)
set_b_rows = Format(
    Format="B{0:00},B,{1:0.000},{2:0},{3:0}",
    Culture=127,
    Data0=set_b_numbers,
    Data1=set_b_cut_lengths_4,
    Data2=multiplication_4,
    Data3=multiplication_6)
csv_rows = Merge(Data1=set_a_rows, Data2=set_b_rows)
csv_lines = Merge(Data1=csv_header_2, Data2=csv_rows)
cut_list = CreateFile(Data=flatten(csv_lines), Name="lamella-cut-list", Extension=".csv", IsBase64=False)

# ---- group: Quantities / Outputs
c_print = ContextPrint(StoredCarbonTCO₂e=format_0_0_0_2)
c_print_2 = ContextPrint(TimberVolumeM³=format_0_0_0)
c_print_3 = ContextPrint(LongestLamellaM=format_0_0_00)
c_print_4 = ContextPrint(CostEstimateEUR=format_0_0_3)
c_print_5 = ContextPrint(LamellaLengthM=format_0_0)
c_bake_2 = ContextBake(LamellaLengths=lengths_chart)
c_print_6 = ContextPrint(ShellAreaM²=format_0_0_2)
lamella_count_2 = LamellaCount(lamella_count)
c_print_7 = ContextPrint(Lamellas=lamella_count)
total_length_2 = TotalLength(total_length.Result)
lamella_too_long = Message(
    Condition=transportable.SmallerThan,
    Message="A lamella is longer than 24 m, past what a glulam truck carries: lower the span or plan a splice.",
    Level=1,
    Notify=1)
shallow_shell = Message(
    Condition=deep_enough.LargerThan,
    Message="Shallow shell: raise the height or reduce the depth, or the lamellas need a deeper section.",
    Level=1,
    Notify=1)

# ---- group: Downloads / Outputs
c_bake_3 = ContextBake(Model3DM=model)
c_bake_4 = ContextBake(CutListCSV=cut_list)

# ---- group: 3D view / Outputs
timber_name_2 = TimberName(timber_name)
c_bake_5 = ContextBake(Pavilion=pavilion)

# ---- group: Plan / Outputs
plan_view_drawings_2 = PlanViewDrawings(plan_view.Drawings)
square_half_length_3 = SquareHalfLength(square_half_length_2)
square_half_width_3 = SquareHalfWidth(square_half_width_2)
footing_circles_2 = FootingCircles(footing_circles)
square_outline_2 = SquareOutline(square_outline.Rectangle)

# ---- group: Section A–A
# SECTION A–A
# Cut through the boards on y = 0 (black), with the lamellas, beams, benches and lamps beyond it.
square_half_length_4 = SquareHalfLength(square_half_length_3)
ground_hatch_3 = GroundHatch(ground_hatch_2)
heavy_4 = Heavy(heavy_2)
all_lamella_lines_4 = AllLamellaLines(all_lamella_lines_2)
hairline_3 = Hairline(hairline_2)
free_edges_4 = FreeEdges(free_edges_2)
medium_4 = Medium(medium_2)
concrete_5 = Concrete(concrete_2)
half_span_4 = HalfSpan(half_span_2)
bench_half_length_3 = BenchHalfLength(bench_half_length_2)
hanging_points_3 = HangingPoints(hanging_points_2)
lamps_5 = Lamps(lamps_2)
thin_4 = Thin(thin_2)
set_a_boards_4 = SetABoards(set_a_boards_2)
height_5 = Height(height)
cut_3 = Cut(cut_2)
set_b_boards_4 = SetBBoards(set_b_boards_2)
section_length_mm_3 = SectionLengthMm(section_length_mm_2)
midpt = CurveMiddle(Curve=all_lamella_lines_4)
midpt_2 = CurveMiddle(Curve=free_edges_4)
lamp_coordinates = Deconstruct(Point=lamps_5)  # -> XComponent, YComponent, ZComponent
sheet_plane = XYPlane(Origin=Point(0, 0, 0))
lamellas_beyond_midpoints = Deconstruct(Point=midpt)  # -> XComponent, YComponent, ZComponent
edges_beyond_midpoints = Deconstruct(Point=midpt_2)  # -> XComponent, YComponent, ZComponent
neg_14 = Negative(Value=half_span_4)
larger_3 = LargerThan(FirstNumber=lamp_coordinates.YComponent, SecondNumber=0)  # -> LargerThan, OrEqualTo
larger_4 = LargerThan(FirstNumber=lamp_coordinates.YComponent, SecondNumber=0)  # -> LargerThan, OrEqualTo
neg_15 = Negative(Value=square_half_length_4)
neg_16 = Negative(Value=square_half_length_4)
larger_5 = LargerThan(FirstNumber=lamellas_beyond_midpoints.YComponent, SecondNumber=-0.05)  # -> LargerThan, OrEqualTo
larger_6 = LargerThan(FirstNumber=edges_beyond_midpoints.YComponent, SecondNumber=-0.05)  # -> LargerThan, OrEqualTo
footing_x = Merge(Data1=neg_14, Data2=half_span_4)
neg_17 = Negative(Value=bench_half_length_3)
section_plane = XZPlane(Origin=Point(0, 0, 0))
hangs_beyond = Dispatch(List=hanging_points_3, DispatchPattern=larger_3.LargerThan)  # -> ListA, ListB
lamps_beyond = Dispatch(List=lamps_5, DispatchPattern=larger_4.LargerThan)  # -> ListA, ListB
lamellas_beyond = Dispatch(List=all_lamella_lines_4, DispatchPattern=larger_5.LargerThan)  # -> ListA, ListB
edges_beyond = Dispatch(List=free_edges_4, DispatchPattern=larger_6.LargerThan)  # -> ListA, ListB
level_x = Evaluate(E="x+1", x=half_span_4)
lamps_in_section = Orient(Geometry=lamps_beyond.ListA, Source=section_plane, Target=sheet_plane)  # -> Geometry, Transform
cut_set_a = BrepPlane(Brep=flatten(set_a_boards_4), Plane=section_plane)  # -> Curves, Points
cut_set_b = BrepPlane(Brep=flatten(set_b_boards_4), Plane=section_plane)  # -> Curves, Points
height_dimension_mm = Evaluate(E="x*1000", x=height_5)
ground_west = ConstructPoint(XCoordinate=neg_16, YCoordinate=0, ZCoordinate=0)
ground_east = ConstructPoint(XCoordinate=square_half_length_4, YCoordinate=0, ZCoordinate=0)
footing_feet = ConstructPoint(XCoordinate=footing_x, YCoordinate=0, ZCoordinate=0)
hangs_in_section = Orient(Geometry=hangs_beyond.ListA, Source=section_plane, Target=sheet_plane)  # -> Geometry, Transform
lamps_in_section_2 = Orient(Geometry=lamps_beyond.ListA, Source=section_plane, Target=sheet_plane)  # -> Geometry, Transform
xy_2 = XYPlane(Origin=Point(0, 0, 0))
xy_3 = XYPlane(Origin=Point(0, 0, 0))
dom_5 = ConstructDomain(DomainStart=neg_15, DomainEnd=square_half_length_4)
dom_6 = ConstructDomain(DomainStart=-0.2, DomainEnd=0)
dom_7 = ConstructDomain(DomainStart=-0.35, DomainEnd=0.35)
dom_8 = ConstructDomain(DomainStart=0, DomainEnd=0.45)
dom_9 = ConstructDomain(DomainStart=neg_17, DomainEnd=bench_half_length_3)
dom_10 = ConstructDomain(DomainStart=0, DomainEnd=0.45)
section_slab = Rectangle(Plane=xy_2, XSize=dom_5, YSize=dom_6, Radius=0)  # -> Rectangle, Length
section_ground = Line(StartPoint=ground_west, EndPoint=ground_east)
section_footings = Rectangle(Plane=footing_feet, XSize=dom_7, YSize=dom_8, Radius=0)  # -> Rectangle, Length
section_bench = Rectangle(Plane=xy_3, XSize=dom_9, YSize=dom_10, Radius=0)  # -> Rectangle, Length
lamellas_in_section = Orient(Geometry=lamellas_beyond.ListA, Source=section_plane, Target=sheet_plane)  # -> Geometry, Transform
edges_in_section = Orient(Geometry=edges_beyond.ListA, Source=section_plane, Target=sheet_plane)  # -> Geometry, Transform
level_0 = ConstructPoint(XCoordinate=level_x, YCoordinate=0, ZCoordinate=0)
section_cords = Line(StartPoint=hangs_in_section.Geometry, EndPoint=lamps_in_section_2.Geometry)
section_lamp_circles = Circle(Plane=lamps_in_section.Geometry, Radius=0.17)
level_crown = ConstructPoint(XCoordinate=level_x, YCoordinate=height_5, ZCoordinate=0)
set_a_cut = Orient(Geometry=cut_set_a.Curves, Source=section_plane, Target=sheet_plane)  # -> Geometry, Transform
set_b_cut = Orient(Geometry=cut_set_b.Curves, Source=section_plane, Target=sheet_plane)  # -> Geometry, Transform
height_dimension_label = Format(Format="{0:0}", Culture=127, Data0=height_dimension_mm)
height_dimension = LinearDimension(PointA=level_0, PointB=level_crown, Offset=-4, Label=height_dimension_label)
draw_slab = DrawCurve(Curve=section_slab.Rectangle, Style=ground_hatch_3)
draw_ground = DrawCurve(Curve=section_ground, Style=heavy_4)
draw_section_footings = DrawCurve(Curve=section_footings.Rectangle, Style=concrete_5)
draw_lamellas_beyond = DrawCurve(Curve=lamellas_in_section.Geometry, Style=hairline_3)
draw_section_bench = DrawCurve(Curve=section_bench.Rectangle, Style=medium_4)
draw_beams_beyond = DrawCurve(Curve=edges_in_section.Geometry, Style=medium_4)
draw_cords = DrawCurve(Curve=section_cords, Style=thin_4)
draw_section_lamps = DrawCurve(Curve=section_lamp_circles, Style=thin_4)
draw_cut_a = DrawCurve(Curve=set_a_cut.Geometry, Style=cut_3)
draw_cut_b = DrawCurve(Curve=set_b_cut.Geometry, Style=cut_3)
section_view_drawings = Merge(
    Data1=draw_slab,
    Data2=draw_ground,
    Data3=draw_lamellas_beyond,
    Data4=draw_beams_beyond,
    Data5=draw_section_footings,
    Data6=draw_section_bench,
    Data7=draw_cords,
    Data8=draw_section_lamps,
    Data9=draw_cut_a,
    Data10=draw_cut_b,
    Data11=height_dimension)
section_view = DrawingView(Drawings=flatten(section_view_drawings), Length=section_length_mm_3, Padding=4, ScaleCaption=False, Units=1)  # -> Drawings, Scale

# ---- group: Sheet 2 / Inputs
set_a_tags_background = SetATagsBackground(ColourSwatch(SwatchColor=RGB(255, 255, 255)))
set_b_tags_background = SetBTagsBackground(ColourSwatch(SwatchColor=RGB(255, 255, 255)))

# ---- group: Sheet 2
# SHEET 2: LAMELLA SCHEDULE
# Every lamella numbered on a key plan, and its length and volume in a table per set. Numbers match the cut list.
view_title_3 = ViewTitle(view_title_2)
set_a_cut_lengths_5 = SetACutLengths(set_a_cut_lengths_2)
scale_text_3 = ScaleText(scale_text_2)
lamella_width_4 = LamellaWidth(lamella_width)
lamella_depth_4 = LamellaDepth(lamella_depth)
set_b_cut_lengths_5 = SetBCutLengths(set_b_cut_lengths_2)
note_text_3 = NoteText(note_text_2)
square_outline_3 = SquareOutline(square_outline_2)
set_a_trimmed_4 = SetATrimmed(set_a_trimmed_2)
lamella_number_3 = LamellaNumber(lamella_number_2)
all_lamella_lines_5 = AllLamellaLines(all_lamella_lines_2)
medium_5 = Medium(medium_2)
hairline_4 = Hairline(hairline_2)
set_b_trimmed_4 = SetBTrimmed(set_b_trimmed_2)
free_edges_5 = FreeEdges(free_edges_2)
plan_length_mm_4 = PlanLengthMm(plan_length_mm_2)
lng_3 = ListLength(List=set_a_cut_lengths_5)
section_m² = Evaluate(E="x*y/10000", x=lamella_width_4, y=lamella_depth_4)
section_m²_2 = Evaluate(E="x*y/10000", x=lamella_width_4, y=lamella_depth_4)
lng_4 = ListLength(List=set_b_cut_lengths_5)
series = Series(Start=1, Step=1, Count=lng_3)
set_a_volumes = Evaluate(E="x*y", x=set_a_cut_lengths_5, y=section_m²)
set_b_volumes = Evaluate(E="x*y", x=set_b_cut_lengths_5, y=section_m²_2)
series_2 = Series(Start=1, Step=1, Count=lng_4)
midpt_3 = CurveMiddle(Curve=set_a_trimmed_4)
midpt_4 = CurveMiddle(Curve=set_b_trimmed_4)
set_a_numbers_2 = Format(Format="A{0:00}", Culture=127, Data0=series)
set_a_volume_text = Format(Format="{0:0.000}", Culture=127, Data0=set_a_volumes)
set_a_length_text = Format(Format="{0:0.000}", Culture=127, Data0=set_a_cut_lengths_5)
set_b_volume_text = Format(Format="{0:0.000}", Culture=127, Data0=set_b_volumes)
set_b_numbers_2 = Format(Format="B{0:00}", Culture=127, Data0=series_2)
set_b_length_text = Format(Format="{0:0.000}", Culture=127, Data0=set_b_cut_lengths_5)
set_a_columns = Entwine(Branch00=set_a_numbers_2, Branch01=set_a_length_text, Branch02=set_a_volume_text, FlattenInputs=True)
set_b_columns = Entwine(Branch00=set_b_numbers_2, Branch01=set_b_length_text, Branch02=set_b_volume_text, FlattenInputs=True)
set_a_tags = DrawText(
    Text=set_a_numbers_2,
    Position=midpt_3,
    Style=lamella_number_3,
    Rotation=45,
    Background=set_a_tags_background,
    Padding=0.3,
    Radius=0)
set_b_tags = DrawText(
    Text=set_b_numbers_2,
    Position=midpt_4,
    Style=lamella_number_3,
    Rotation=-45,
    Background=set_b_tags_background,
    Padding=0.3,
    Radius=0)
key_square = DrawCurve(Curve=square_outline_3, Style=medium_5)
key_lamellas = DrawCurve(Curve=all_lamella_lines_5, Style=hairline_4)
key_edges = DrawCurve(Curve=free_edges_5, Style=medium_5)
title_strip = TitleBlock(
    Variant=1,
    Project="Selva showcase",
    Title="Timber lamella pavilion: lamella schedule",
    DrawingNo="LP-101",
    Revision="A",
    Scale=scale_text_3,
    Sheet="{page}/{pages}",
    Date="{date:dd.MM.yyyy}",
    Width=190)
set_b_anchor = ConstructPoint(XCoordinate=0, YCoordinate=0, ZCoordinate=0)
set_a_rows_2 = FlipMatrix(Data=set_a_columns)
set_a_anchor = ConstructPoint(XCoordinate=0, YCoordinate=0, ZCoordinate=0)
set_b_rows_2 = FlipMatrix(Data=set_b_columns)
key_plan_view_drawings = Merge(Data1=key_square, Data2=key_lamellas, Data3=key_edges, Data4=set_a_tags, Data5=set_b_tags)
key_plan_anchor = ConstructPoint(XCoordinate=0, YCoordinate=0, ZCoordinate=0)
key_plan_text = Format(Format="KEY PLAN   {0}", Culture=127, Data0=scale_text_3)
key_plan_view = DrawingView(Drawings=flatten(key_plan_view_drawings), Length=plan_length_mm_4, Padding=4, ScaleCaption=False, Units=1)  # -> Drawings, Scale
sheet_2_footer_parts = Merge(Data1=flatten(title_strip))
set_a_schedule = Table(
    Headers=["Lamella", "Length (m)", "Volume (m³)"],
    Rows=set_a_rows_2,
    ColumnWidths=[18, 24, 24],
    RowHeight=4.2,
    DefaultStyle=note_text_3,
    ColumnAlign=["l", "r", "r"],
    BorderStyle=1)
set_b_schedule = Table(
    Headers=["Lamella", "Length (m)", "Volume (m³)"],
    Rows=set_b_rows_2,
    ColumnWidths=[18, 24, 24],
    RowHeight=4.2,
    DefaultStyle=note_text_3,
    ColumnAlign=["l", "r", "r"],
    BorderStyle=1)
set_b_2 = DrawText(Text="SET B", Position=set_b_anchor, Style=view_title_3, Rotation=0, Padding=1, Radius=0)
set_a_2 = DrawText(Text="SET A", Position=set_a_anchor, Style=view_title_3, Rotation=0, Padding=1, Radius=0)
key_plan = DrawText(Text=key_plan_text, Position=key_plan_anchor, Style=view_title_3, Rotation=0, Padding=1, Radius=0)
sheet_2_layout_cells = Merge(
    Data1=flatten(key_plan),
    Data2=flatten(set_a_2),
    Data3=flatten(set_b_2),
    Data4=flatten(key_plan_view.Drawings),
    Data5=flatten(set_a_schedule),
    Data6=flatten(set_b_schedule))
sheet_2_footer = Stack(Drawings=sheet_2_footer_parts, Orientation=1, Spacing=12, CrossAlign=2)
sheet_2_layout = Grid(
    ColumnWidths=[0, 0, 0],
    Drawings=flatten(sheet_2_layout_cells),
    AtRow=[0, 0, 0, 1, 1, 1],
    AtColumn=[0, 1, 2, 0, 1, 2],
    ColumnSpacing=20,
    RowSpacing=5,
    Columns=0)
sheet_2_footer_override = LayoutOverride(Footer=sheet_2_footer, FooterAlign=2, FooterPlacement=1, Units=1)
sheet_2 = Page(
    Drawings=sheet_2_layout,
    Title="Lamella schedule",
    Override=sheet_2_footer_override,
    KeepTogether=True,
    Arrange=0,
    Spacing=5)

# ---- group: Section A–A / Outputs
section_view_drawings_2 = SectionViewDrawings(section_view.Drawings)
sheet_plane_2 = SheetPlane(sheet_plane)

# ---- group: Sheet 2 / Outputs
sheet_2_2 = Sheet2(sheet_2)

# ---- group: East elevation
# EAST ELEVATION
# The whole shell seen from the east: its end arch, every lamella behind it, footings, benches and lamps.
square_half_width_4 = SquareHalfWidth(square_half_width_3)
ground_hatch_4 = GroundHatch(ground_hatch_2)
all_lamella_lines_6 = AllLamellaLines(all_lamella_lines_2)
heavy_5 = Heavy(heavy_2)
free_edges_6 = FreeEdges(free_edges_2)
half_depth_4 = HalfDepth(half_depth_2)
bench_offset_3 = BenchOffset(bench_offset_2)
concrete_6 = Concrete(concrete_2)
medium_6 = Medium(medium_2)
hanging_points_4 = HangingPoints(hanging_points_2)
sheet_plane_3 = SheetPlane(sheet_plane_2)
thin_5 = Thin(thin_2)
lamps_6 = Lamps(lamps_2)
height_6 = Height(height)
end_length_mm_3 = EndLengthMm(end_length_mm_2)
neg_18 = Negative(Value=half_depth_4)
neg_19 = Negative(Value=bench_offset_3)
neg_20 = Negative(Value=square_half_width_4)
neg_21 = Negative(Value=square_half_width_4)
footing_y = Merge(Data1=neg_18, Data2=half_depth_4)
bench_y = Merge(Data1=neg_19, Data2=bench_offset_3)
elevation_plane = YZPlane(Origin=Point(0, 0, 0))
ground_south = ConstructPoint(XCoordinate=neg_21, YCoordinate=0, ZCoordinate=0)
ground_north = ConstructPoint(XCoordinate=square_half_width_4, YCoordinate=0, ZCoordinate=0)
footing_feet_y = ConstructPoint(XCoordinate=footing_y, YCoordinate=0, ZCoordinate=0)
bench_feet = ConstructPoint(XCoordinate=bench_y, YCoordinate=0, ZCoordinate=0)
level_y = Evaluate(E="x+1", x=half_depth_4)
lamps_in_elevation = Orient(Geometry=lamps_6, Source=elevation_plane, Target=sheet_plane_3)  # -> Geometry, Transform
end_height_dimension_mm = Evaluate(E="x*1000", x=height_6)
hangs_in_elevation = Orient(Geometry=hanging_points_4, Source=elevation_plane, Target=sheet_plane_3)  # -> Geometry, Transform
lamps_in_elevation_2 = Orient(Geometry=lamps_6, Source=elevation_plane, Target=sheet_plane_3)  # -> Geometry, Transform
xy_4 = XYPlane(Origin=Point(0, 0, 0))
dom_11 = ConstructDomain(DomainStart=neg_20, DomainEnd=square_half_width_4)
dom_12 = ConstructDomain(DomainStart=-0.2, DomainEnd=0)
dom_13 = ConstructDomain(DomainStart=-0.35, DomainEnd=0.35)
dom_14 = ConstructDomain(DomainStart=0, DomainEnd=0.45)
dom_15 = ConstructDomain(DomainStart=-0.25, DomainEnd=0.25)
dom_16 = ConstructDomain(DomainStart=0, DomainEnd=0.45)
elevation_slab = Rectangle(Plane=xy_4, XSize=dom_11, YSize=dom_12, Radius=0)  # -> Rectangle, Length
elevation_ground = Line(StartPoint=ground_south, EndPoint=ground_north)
elevation_footings = Rectangle(Plane=footing_feet_y, XSize=dom_13, YSize=dom_14, Radius=0)  # -> Rectangle, Length
elevation_benches = Rectangle(Plane=bench_feet, XSize=dom_15, YSize=dom_16, Radius=0)  # -> Rectangle, Length
lamellas_in_elevation = Orient(Geometry=all_lamella_lines_6, Source=elevation_plane, Target=sheet_plane_3)  # -> Geometry, Transform
edges_in_elevation = Orient(Geometry=free_edges_6, Source=elevation_plane, Target=sheet_plane_3)  # -> Geometry, Transform
end_level_0 = ConstructPoint(XCoordinate=level_y, YCoordinate=0, ZCoordinate=0)
elevation_cords = Line(StartPoint=hangs_in_elevation.Geometry, EndPoint=lamps_in_elevation_2.Geometry)
end_level_crown = ConstructPoint(XCoordinate=level_y, YCoordinate=height_6, ZCoordinate=0)
elevation_lamp_circles = Circle(Plane=lamps_in_elevation.Geometry, Radius=0.17)
end_height_dimension_label = Format(Format="{0:0}", Culture=127, Data0=end_height_dimension_mm)
end_height_dimension = LinearDimension(PointA=end_level_0, PointB=end_level_crown, Offset=-4, Label=end_height_dimension_label)
draw_elevation_slab = DrawCurve(Curve=elevation_slab.Rectangle, Style=ground_hatch_4)
draw_elevation_ground = DrawCurve(Curve=elevation_ground, Style=heavy_5)
draw_elevation_beams = DrawCurve(Curve=edges_in_elevation.Geometry, Style=heavy_5)
draw_elevation_footings = DrawCurve(Curve=elevation_footings.Rectangle, Style=concrete_6)
draw_elevation_benches = DrawCurve(Curve=elevation_benches.Rectangle, Style=medium_6)
draw_elevation_lamellas = DrawCurve(Curve=lamellas_in_elevation.Geometry, Style=thin_5)
draw_elevation_cords = DrawCurve(Curve=elevation_cords, Style=thin_5)
draw_elevation_lamps = DrawCurve(Curve=elevation_lamp_circles, Style=thin_5)
elevation_view_drawings = Merge(
    Data1=draw_elevation_slab,
    Data2=draw_elevation_ground,
    Data3=draw_elevation_lamellas,
    Data4=draw_elevation_beams,
    Data5=draw_elevation_footings,
    Data6=draw_elevation_benches,
    Data7=draw_elevation_cords,
    Data8=draw_elevation_lamps,
    Data9=end_height_dimension)
elevation_view = DrawingView(Drawings=flatten(elevation_view_drawings), Length=end_length_mm_3, Padding=4, ScaleCaption=False, Units=1)  # -> Drawings, Scale

# ---- group: Axonometric
# AXONOMETRIC
# The model seen from the south-east and above: the view plane's x runs (1, 1, 0) and its y (-1, 1, 2).
square_outline_4 = SquareOutline(square_outline_2)
depth_m_5 = DepthM(depth_m_2)
all_lamella_lines_7 = AllLamellaLines(all_lamella_lines_2)
hairline_5 = Hairline(hairline_2)
medium_7 = Medium(medium_2)
sheet_plane_4 = SheetPlane(sheet_plane_2)
free_edges_7 = FreeEdges(free_edges_2)
heavy_6 = Heavy(heavy_2)
footing_circles_3 = FootingCircles(footing_circles_2)
thin_6 = Thin(thin_2)
bench_outlines_4 = BenchOutlines(bench_outlines_2)
axo_length_mm_3 = AxoLengthMm(axo_length_mm_2)
neg_22 = Negative(Value=depth_m_5)
Z_4 = UnitZ(Factor=neg_22)
axo_origin = ConstructPoint(XCoordinate=0, YCoordinate=0, ZCoordinate=0)
vec = VectorXYZ(XComponent=1, YComponent=1, ZComponent=0)  # -> Vector, Length
vec_2 = VectorXYZ(XComponent=-1, YComponent=1, ZComponent=2)  # -> Vector, Length
axo_plane = ConstructPlane(Origin=axo_origin, XAxis=vec.Vector, YAxis=vec_2.Vector)
lamella_undersides = Move(Geometry=all_lamella_lines_7, Motion=Z_4)  # -> Geometry, Transform
square_in_axo = Orient(Geometry=square_outline_4, Source=axo_plane, Target=sheet_plane_4)  # -> Geometry, Transform
undersides_in_axo = Orient(Geometry=lamella_undersides.Geometry, Source=axo_plane, Target=sheet_plane_4)  # -> Geometry, Transform
lamellas_in_axo = Orient(Geometry=all_lamella_lines_7, Source=axo_plane, Target=sheet_plane_4)  # -> Geometry, Transform
edges_in_axo = Orient(Geometry=free_edges_7, Source=axo_plane, Target=sheet_plane_4)  # -> Geometry, Transform
footings_in_axo = Orient(Geometry=footing_circles_3, Source=axo_plane, Target=sheet_plane_4)  # -> Geometry, Transform
benches_in_axo = Orient(Geometry=bench_outlines_4, Source=axo_plane, Target=sheet_plane_4)  # -> Geometry, Transform
draw_axo_undersides = DrawCurve(Curve=undersides_in_axo.Geometry, Style=hairline_5)
draw_axo_square = DrawCurve(Curve=square_in_axo.Geometry, Style=medium_7)
draw_axo_lamellas = DrawCurve(Curve=lamellas_in_axo.Geometry, Style=thin_6)
draw_axo_footings = DrawCurve(Curve=footings_in_axo.Geometry, Style=medium_7)
draw_axo_beams = DrawCurve(Curve=edges_in_axo.Geometry, Style=heavy_6)
draw_axo_benches = DrawCurve(Curve=benches_in_axo.Geometry, Style=thin_6)
axo_view_drawings = Merge(
    Data1=draw_axo_square,
    Data2=draw_axo_undersides,
    Data3=draw_axo_lamellas,
    Data4=draw_axo_beams,
    Data5=draw_axo_footings,
    Data6=draw_axo_benches)
axo_view = DrawingView(Drawings=flatten(axo_view_drawings), Length=axo_length_mm_3, Padding=4, ScaleCaption=False, Units=1)  # -> Drawings, Scale

# ---- group: Axonometric / Outputs
axo_view_drawings_2 = AxoViewDrawings(axo_view.Drawings)

# ---- group: East elevation / Outputs
elevation_view_drawings_2 = ElevationViewDrawings(elevation_view.Drawings)

# ---- group: Sheet 1
# SHEET 1: GENERAL ARRANGEMENT
# Plan and axonometric on top, section and elevation below. The notes and title block sit in the footer, bottom right.
lamella_spacing_4 = LamellaSpacing(lamella_spacing)
lamella_depth_5 = LamellaDepth(lamella_depth)
lamella_width_5 = LamellaWidth(lamella_width)
view_title_4 = ViewTitle(view_title_2)
scale_text_4 = ScaleText(scale_text_2)
note_text_4 = NoteText(note_text_2)
timber_name_3 = TimberName(timber_name_2)
section_view_drawings_3 = SectionViewDrawings(section_view_drawings_2)
elevation_view_drawings_3 = ElevationViewDrawings(elevation_view_drawings_2)
beam_radius_3 = BeamRadius(beam_radius_2)
axo_view_drawings_3 = AxoViewDrawings(axo_view_drawings_2)
plan_view_drawings_3 = PlanViewDrawings(plan_view_drawings_2)
total_length_3 = TotalLength(total_length_2)
lamella_count_3 = LamellaCount(lamella_count_2)
multiplication_7 = Multiplication(A=lamella_width_5, B=10)
multiplication_8 = Multiplication(A=lamella_depth_5, B=10)
beam_diameter_mm = Evaluate(E="x*2000", x=beam_radius_3)
notes_text = Format(
    Format="""NOTES
1. Dimensions in millimetres, heights above the finished square.
2. Lamellas: {0} glulam, {1:0} × {2:0} mm, {3} pieces, {4:0} m in all.
3. Lamellas cut on vertical planes at 45°, {5:0.00} m apart.
4. Edge beams: steel tube Ø {6:0} mm. Footings: concrete Ø 700 mm.
5. Drawn by Selva from the model: change an input and the sheet redraws.""",
    Culture=127,
    Data0=timber_name_3,
    Data1=multiplication_7,
    Data2=multiplication_8,
    Data3=lamella_count_3,
    Data4=total_length_3,
    Data5=lamella_spacing_4,
    Data6=beam_diameter_mm)
title_block = TitleBlock(
    Project="Selva showcase",
    Owner="Example client",
    Title="Timber lamella pavilion: general arrangement",
    DrawingNo="LP-100",
    Revision="A",
    Scale=scale_text_4,
    Sheet="{page}/{pages}",
    CreatedBy="Selva",
    Date="{date:dd.MM.yyyy}",
    Width=190)
notes = TextFlow(Text=notes_text, Width=190, Style=note_text_4)
axonometric_anchor = ConstructPoint(XCoordinate=0, YCoordinate=0, ZCoordinate=0)
plan_anchor = ConstructPoint(XCoordinate=0, YCoordinate=0, ZCoordinate=0)
east_elevation_anchor = ConstructPoint(XCoordinate=0, YCoordinate=0, ZCoordinate=0)
section_a_a_anchor = ConstructPoint(XCoordinate=0, YCoordinate=0, ZCoordinate=0)
plan_text = Format(Format="PLAN   {0}", Culture=127, Data0=scale_text_4)
section_a_a_text = Format(Format="SECTION A–A   {0}", Culture=127, Data0=scale_text_4)
east_elevation_text = Format(Format="EAST ELEVATION   {0}", Culture=127, Data0=scale_text_4)
sheet_1_footer_parts = Merge(Data1=flatten(notes), Data2=flatten(title_block))
axonometric = DrawText(Text="AXONOMETRIC", Position=axonometric_anchor, Style=view_title_4, Rotation=0, Padding=1, Radius=0)
plan = DrawText(Text=plan_text, Position=plan_anchor, Style=view_title_4, Rotation=0, Padding=1, Radius=0)
section_a_a = DrawText(Text=section_a_a_text, Position=section_a_a_anchor, Style=view_title_4, Rotation=0, Padding=1, Radius=0)
east_elevation = DrawText(Text=east_elevation_text, Position=east_elevation_anchor, Style=view_title_4, Rotation=0, Padding=1, Radius=0)
sheet_1_layout_cells = Merge(
    Data1=flatten(plan_view_drawings_3),
    Data2=flatten(axo_view_drawings_3),
    Data3=flatten(plan),
    Data4=flatten(axonometric),
    Data5=flatten(section_view_drawings_3),
    Data6=flatten(elevation_view_drawings_3),
    Data7=flatten(section_a_a),
    Data8=flatten(east_elevation))
sheet_1_footer = Stack(Drawings=sheet_1_footer_parts, Orientation=1, Spacing=12, CrossAlign=2)
sheet_1_layout = Grid(
    ColumnWidths=[0, -1],
    Drawings=flatten(sheet_1_layout_cells),
    AtRow=[0, 0, 1, 1, 2, 2, 3, 3],
    AtColumn=[0, 1, 0, 1, 0, 1, 0, 1],
    ColumnSpacing=20,
    RowSpacing=5,
    Columns=0)
sheet_1_footer_override = LayoutOverride(Footer=sheet_1_footer, FooterAlign=2, FooterPlacement=1, Units=1)
sheet_1 = Page(
    Drawings=sheet_1_layout,
    Title="General arrangement",
    Override=sheet_1_footer_override,
    KeepTogether=True,
    Arrange=0,
    Spacing=5)

# ---- group: Sheet 1 / Outputs
sheet_1_2 = Sheet1(sheet_1)

# ---- group: Drawing set
# DRAWING SET
# Both sheets on A2 landscape with 12 mm margins, rendered to one PDF.
sheet_1_3 = Sheet1(sheet_1_2)
sheet_2_3 = Sheet2(sheet_2_2)
pages = Merge(Data1=sheet_1_3, Data2=sheet_2_3)
a2_landscape = LayoutOverride(PaperSize=2, Landscape=True, Margin=12, Units=1)
drawing_set = Document(Pages=pages, Title="Timber lamella pavilion", Author="Selva", Override=a2_landscape, Culture="en-US")
drawing_the_sheets = ReportProgress(Data=drawing_set, Message="Drawing the sheets…")
pdf = RenderPDF(Document=drawing_the_sheets, Name="lamella-pavilion-drawings", AutoFit=False)

# ---- group: Drawing set / Outputs
c_bake_6 = ContextBake(DrawingsPDF=pdf)
