# Grasshopper definition live_solve_showcase.ghx (Grasshopper 1.0.8)
# plug-ins: Selva

# ---- group: Solve behaviour: stage delay + incidental noise
noise_options = ValueList({"none", "warning", "error", "exception"}, selected="warning")
stage_delay_s = Slider(0, range=0..3)
stage_delay_s_2 = GetNumber(stage_delay_s, AtLeast=1, AtMost=1, Maximum=1.797693135e+308, Minimum=-1.797693135e+308, TreeAccess=False)
incidental_message = GetValueList(
    noise_options,
    AtLeast=1,
    AtMost=1,
    Immediate=True,
    ListAccess=False,
    StoredItems="""[
  {
    "name": "none",
    "expression": "none"
  },
  {
    "name": "warning",
    "expression": "warning"
  },
  {
    "name": "error",
    "expression": "error"
  },
  {
    "name": "exception",
    "expression": "exception"
  }
]""",
    TreeAccess=False)
noise_text = Text(incidental_message)

# ----
get_un = Slider(10, range=0..250)
radius_scale = Slider(1, range=0.2..3)
mode_options = ValueList({"Spheres", "Voronoi cells"}, selected="Spheres")
sphere_count = GetInteger(get_un, AtLeast=1, AtMost=1, Maximum=2147483647, Minimum=-2147483648, TreeAccess=False)
radius_scale_2 = GetNumber(radius_scale, AtLeast=1, AtMost=1, Maximum=1.797693135e+308, Minimum=-1.797693135e+308, TreeAccess=False)
mode = GetValueList(
    mode_options,
    AtLeast=1,
    AtMost=1,
    Immediate=True,
    ListAccess=False,
    StoredItems="""[
  {
    "name": "Spheres",
    "expression": "Spheres"
  },
  {
    "name": "Voronoi cells",
    "expression": "Voronoi cells"
  }
]""",
    TreeAccess=False)
ui_bridge = UIBridge(
    Enable=Toggle(True),
    Schema="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",
    Values="{\"819cb5c6-bdd5-4580-aac8-441d410bb4ae\":\"warning\",\"b727a278-8586-4e3e-a57f-8fd189003cea\":1,\"03398815-8e1e-40eb-9f6e-f773c9296a65\":10,\"ccd23254-11da-4761-8e69-9b892de180d8\":0,\"7830acd3-605c-4c43-8f2e-5653d701fe68\":\"warm\",\"be715bd1-c593-4954-9a1b-529d4056d0df\":\"Spheres\"}")  # -> Schema, URL
get_geometry = GetGeometry(AnnotationTypeFilter=3966, AtLeast=1, AtMost=1, DeleteInput=False, Filter=4, TreeAccess=False)
random = Random(Range="1 to 100", Number=sphere_count, Seed=2)
random_2 = Random(Range="1 to 100", Number=sphere_count, Seed="29")
random_3 = Random(Range="1 to 100", Number=sphere_count, Seed="12")
random_4 = Random(Range="1 to 20", Number=sphere_count, Seed="20")
context_bake = ContextBake(Content=ui_bridge.Schema)
curve = Curve(get_geometry)
integer = Integer(random_4)
construct_point = ConstructPoint(XCoordinate=random, YCoordinate=random_2, ZCoordinate=random_3)
mode_text = Text(mode)
multiplication = Multiplication(A=integer, B=radius_scale_2)
mode_2 = ContextPrint(Text=mode)
panel = Panel("""Spheres
Voronoi cells""")
sphere = Sphere(Base=construct_point, Radius=multiplication)
mode_index = MemberIndex(Set=panel, Member=mode_text)  # -> Index, Count
list_length = ListLength(List=sphere)
larger_than = LargerThan(FirstNumber=list_length, SecondNumber=100)  # -> LargerThan, OrEqualTo
panel_2 = Panel(""""Warm" = warm
"Cool" = cool
"Mono" = mono""")
panel_3 = Panel(""""Warm" = warm
"Cool" = cool
"Mono" = mono
"Rainbow" = rainbow""")

smaller_than = SmallerThan(FirstNumber="40", SecondNumber=list_length)  # -> SmallerThan, OrEqualTo
larger_than_2 = LargerThan(FirstNumber="60", SecondNumber=list_length)  # -> LargerThan, OrEqualTo
smaller_than_2 = SmallerThan(FirstNumber=list_length, SecondNumber=200)  # -> SmallerThan, OrEqualTo
panel_4 = Panel("More than 200 spheres is too heavy for the web viewer: refused")
message = Message(Condition=smaller_than.SmallerThan, Message="Only a few spheres", Level=1, Notify=1)
message_2 = Message(Condition=larger_than_2.LargerThan, Message="You got a lot of spheres", Level=0, Notify=0)
too_many = Message(Condition=smaller_than_2.SmallerThan, Message=panel_4, Level=2, Notify=0)

palette_options = StreamFilter(Gate=larger_than.LargerThan, Stream0=panel_2, Stream1=panel_3)

equality = Equality(FirstNumber=mode_index.Index, SecondNumber=0)  # -> Equality, Inequality
smaller_than_3 = SmallerThan(FirstNumber=radius_scale_2, SecondNumber=2)  # -> SmallerThan, OrEqualTo
overlap = Message(
    Condition=smaller_than_3.SmallerThan,
    Message="Radius scale above 2 makes the spheres overlap heavily",
    Level=1,
    Notify=0)
voronoi_note = Message(Condition=equality.Equality, Message="Voronoi cells take a moment for many points", Level=0, Notify=0)

# ---- group: Notify = Log
smaller_than_4 = SmallerThan(FirstNumber=stage_delay_s_2, SecondNumber=3)  # -> SmallerThan, OrEqualTo
message_3 = Message(
    Condition=smaller_than_4.SmallerThan,
    Message="Stage delay of 3 s or more: logged only, never a popup",
    Level=1,
    Notify=1)

# ----
set_palette = SetDynamicValueList(Options=palette_options)
panel_5 = Panel("""warm
cool
mono
rainbow""")
palette = GetDynamicValueList(
    palette_options,
    AtLeast=1,
    AtMost=1,
    Immediate=True,
    ListAccess=False,
    StoredItems="""[
  {
    "name": "Warm",
    "expression": "warm"
  },
  {
    "name": "Cool",
    "expression": "cool"
  },
  {
    "name": "Mono",
    "expression": "mono"
  }
]""",
    TreeAccess=False)
palette_options_2 = ContextBake(PaletteOptions=set_palette)
palette_text = Text(palette)
sphere_count_2 = ContextPrint(SphereCount=list_length)
palette_colours = Colour([RGB(224, 122, 95), RGB(88, 150, 214), RGB(140, 140, 140), RGB(160, 90, 220)])
palette_index = MemberIndex(Set=panel_5, Member=palette_text)  # -> Index, Count
palette_colour = ListItem(List=palette_colours, Index=palette_index.Index, Wrap=True)
voronoi_box = CenterBox(Base=PlaneXY(50.5, 50.5, 50.5), X=52, Y=52, Z=52)
voronoi_3d = Voronoi3D(Points=construct_point, Box=voronoi_box)  # -> Cells, Boundary
volume = Volume(Geometry=voronoi_3d.Cells)  # -> Volume, Centroid
shrink_cells = Scale(Geometry=voronoi_3d.Cells, Center=volume.Centroid, Factor=0.8)  # -> Geometry, Transform
three_material = ThreeMaterial(Color=palette_colour, Metalness=0, Roughness=Slider(0.23, range=0..1), Opacity=1, Transparent=False)
pick_geometry = StreamFilter(Gate=mode_index.Index, Stream0=sphere, Stream1=shrink_cells.Geometry)
report_progress = ReportProgress(Data=pick_geometry, Message="Preparing geometry…")
statetest = GetNumber(Slider(10, range=10..30), AtLeast=1, AtMost=1, Maximum=1.797693135e+308, Minimum=-1.797693135e+308, TreeAccess=False)
context_print = ContextPrint(Text=statetest)

# ---- group: Slow stages: abort lands between them; progress hooks in here
slow_stage_1 = CSharpScript(geo=report_progress, delay=stage_delay_s_2)  # -> out, pass; inputs geo: list
# ---------- slow_stage_1: C# ----------
// Slow stage: sleeps `delay` seconds, then passes the geometry through unchanged. The Report
// Progress before it names the stage; the sleep is split into ticks only so an abort lands
// mid-stage, since Grasshopper itself only stops between components.
using System;
using System.Collections.Generic;
using System.Threading;

public class Script_Instance : GH_ScriptInstance
{
    private const int Ticks = 10;

    private void RunScript(List<object> geo, object delay, ref object pass)
    {
        var doc = Component.OnPingDocument();
        var seconds = delay == null ? 0 : Convert.ToDouble(delay);
        for (var tick = 0; seconds > 0 && tick < Ticks; tick++)
        {
            if (doc != null && doc.AbortRequested) break;
            Thread.Sleep(TimeSpan.FromSeconds(seconds / Ticks));
        }
        pass = geo;
    }
}
# ---------- end slow_stage_1 ----------

# ----
report_progress_2 = ReportProgress(Data=slow_stage_1.pass, Message="Refining the layout…")

# ---- group: Slow stages: abort lands between them; progress hooks in here (continued)
slow_stage_2 = CSharpScript(geo=report_progress_2, delay=stage_delay_s_2)  # -> out, pass; inputs geo: list; same code as slow_stage_1
noise_stage = CSharpScript(geo=slow_stage_2.pass, noise=noise_text)  # -> out, pass; inputs geo: list
# ---------- noise_stage: C# ----------
// Incidental Grasshopper noise: messages no Selva Message component wrote. They must
// reach the message log without interrupting the user or blocking the result.
using System;
using System.Collections.Generic;
using Grasshopper.Kernel;

public class Script_Instance : GH_ScriptInstance
{
    private void RunScript(List<object> geo, object noise, ref object pass)
    {
        switch (Convert.ToString(noise).Trim().ToLowerInvariant())
        {
            case "warning":
                Component.AddRuntimeMessage(GH_RuntimeMessageLevel.Warning, "Incidental warning from a script component");
                break;
            case "error":
                Component.AddRuntimeMessage(GH_RuntimeMessageLevel.Error, "Incidental error from a script component");
                break;
            case "exception":
                throw new InvalidOperationException("Script component threw on purpose");
        }
        pass = geo;
    }
}
# ---------- end noise_stage ----------

# ----
report_progress_3 = ReportProgress(Data=noise_stage.pass, Message="Checking the result…")

# ---- group: Slow stages: abort lands between them; progress hooks in here (continued)
slow_stage_3 = CSharpScript(geo=report_progress_3, delay=stage_delay_s_2)  # -> out, pass; inputs geo: list; same code as slow_stage_1

# ----
report_progress_4 = ReportProgress(Data=slow_stage_3.pass, Message="Finishing up…")

# ---- group: Slow stages: abort lands between them; progress hooks in here (continued)
slow_stage_4 = CSharpScript(geo=report_progress_4, delay=stage_delay_s_2)  # -> out, pass; inputs geo: list; same code as slow_stage_1

# ----
display = Display(Geo=slow_stage_4.pass, Material=three_material)
context_bake_2 = ContextBake(Content=display)
