# Grasshopper definition builder_test.gh (Grasshopper 1.0.8)
# plug-ins: Selva

radius = Slider(7, range=0..20)
heigth = Slider(10, range=10..20)
width = Slider(10, range=10..20)
types = ValueList({"Sphere": 0, "Cylinder": 1, "Box": 2}, selected="Box")
copy_up = GetBoolean("false", AtLeast=1, AtMost=1, FalseValue="False", TreeAccess=False, TrueValue="True")
radius_2 = GetNumber(radius, AtLeast=1, AtMost=1, Maximum=25, Minimum=5, TreeAccess=False)
width_2 = GetNumber(heigth, AtLeast=1, AtMost=1, Maximum=20, Minimum=5, TreeAccess=False)
heigth_2 = GetNumber(width, AtLeast=1, AtMost=1, Maximum=20, Minimum=5, TreeAccess=False)
geo_type = GetValueList(
    types,
    AtLeast=1,
    AtMost=1,
    Immediate=True,
    StoredItems="""[
  {
    "name": "Sphere",
    "expression": "0"
  },
  {
    "name": "Cylinder",
    "expression": "1"
  },
  {
    "name": "Box",
    "expression": "2"
  }
]""",
    TreeAccess=False)
cylinder = Cylinder(Base=PlaneXY(0, 0, 0), Radius=radius_2, Length=heigth_2)
sphere = Sphere(Base=PlaneXY(0, 0, 0), Radius=radius_2)
center_box = CenterBox(Base=PlaneXY(0, 0, 0), X=radius_2, Y=width_2, Z=heigth_2)
cap_holes = CapHoles(Brep=cylinder)
stream_filter = StreamFilter(Gate=geo_type, Stream0=sphere, Stream1=cap_holes, Stream2=center_box)
bounding_box = BoundingBox(Content=stream_filter, Plane=PlaneXY(0, 0, 0))  # -> Box, Box_2
deconstruct_box = DeconstructBox(Box=bounding_box.Box)  # -> Plane, X, Y, Z
unit_z = UnitZ(Factor=deconstruct_box.Z)
move = Move(Geometry=stream_filter, Motion=unit_z)  # -> Geometry, Transform
merge = Merge(Data1=stream_filter, Data2=move.Geometry)  # -> flatten(Result)
stream_filter_2 = StreamFilter(Gate=copy_up, Stream0=stream_filter, Stream1=merge)
material_color = ColourSwatch(SwatchColor=RGB(199, 165, 165))
three_material = ThreeMaterial(Color=material_color, Metalness="0.95", Roughness="0.25", Opacity=1, Transparent=False)
panel = Panel("""Test2
Test3""")
merge_2 = Merge(Data1=stream_filter_2, Data2=stream_filter_2)  # -> graft(Result)
display = Display(Geo=stream_filter_2, ThreeMaterial=three_material)
area = Area(Geometry=stream_filter_2)  # -> Area, Centroid
datatofile = DataToFile(Geometry=merge_2, FileNames=panel, FileEnding=".3dm")
datatofile_2 = DataToFile(Geometry=stream_filter_2, FileNames="Test", FileEnding=".3dm")
name_that_should_not_be_named = ContextBake(Content=display)
second = ContextBake(Content=datatofile)
context_bake = ContextBake(Content=datatofile_2)
area_2 = ContextPrint(Text=area.Area)
ui_builder = UIBuilder(
    Enable=Toggle(True),
    Schema="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",
    SessionId="ydx2R4fW",
    Values="{\"8426f660-a18e-44bf-8529-89e5a32fd753\":\"Box\"}")  # -> SessionID, Info, Schema

schema = ContextPrint(Schema=ui_builder.Schema)
