# Grasshopper definition option_test.gh (Grasshopper 1.0.8)
# plug-ins: Selva

material = ValueList({"Aluminum": 0, "Steel": 1, "Copper": 2}, selected="Aluminum")
aluminum = ValueList({"6061-T6 (Structural)": 6061-T6, "6063-T5 (Architectural Extrusions)": 6063-T5, "5052-H32 (Marine / Sheet)": 5052-H32, "7075-T6 (High Strength)": 7075-T6}, selected="7075-T6 (High Strength)")
steel = ValueList({"A36", "A572 Grade 50": A572, "A992", "A500 Grade B": A500}, selected="A36")
copper = ValueList({"C110 (ETP Copper)": C110, "C101 (Oxygen-Free Copper)": C101, "C122 (DHP Copper)": C122, "C102 (Oxygen-Free High Conductivity)": C102}, selected="C102 (Oxygen-Free High Conductivity)")
ui_bridge = UIBridge(
    Enable=Toggle(True),
    Schema="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",
    SessionId="5EnMajT8",
    Values="{\"3a91923c-c5e3-4ea9-8afd-e71fe0b2dafd\":10,\"a3cce961-bfaa-4d89-89a5-29500b92d8e3\":\"Aluminum\"}")
material_2 = GetValueList(
    material,
    AtLeast=1,
    AtMost=1,
    Immediate=True,
    StoredItems="""[
  {
    "name": "Aluminum",
    "expression": "0"
  },
  {
    "name": "Steel",
    "expression": "1"
  },
  {
    "name": "Copper",
    "expression": "2"
  }
]""",
    TreeAccess=False)
aluminum_2 = GetValueList(aluminum, AtLeast=1, AtMost=1, Immediate=True, StoredItems="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", TreeAccess=False)
copper_2 = GetValueList(
    steel,
    AtLeast=1,
    AtMost=1,
    Immediate=True,
    StoredItems="""[
  {
    "name": "A36",
    "expression": "A36"
  },
  {
    "name": "A572 Grade 50",
    "expression": "A572"
  },
  {
    "name": "A992",
    "expression": "A992"
  },
  {
    "name": "A500 Grade B",
    "expression": "A500"
  }
]""",
    TreeAccess=False)
steel_2 = GetValueList(copper, AtLeast=1, AtMost=1, Immediate=True, StoredItems="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", TreeAccess=False)
example_number_1 = GetNumber(Slider(10, range=0..20), AtLeast=1, AtMost=1, Maximum=1.797693135e+308, Minimum=-1.797693135e+308, TreeAccess=False)
example_string_1 = GetString("test", AtLeast=1, AtMost=1, TreeAccess=False)
evaluate_schema = EvaluateSchema(Schema=ui_bridge)  # -> Info, JSON, InputCount, OutputCount
example_bool_1 = GetBoolean(Toggle(False), AtLeast=1, AtMost=1, FalseValue="False", TreeAccess=False, TrueValue="True")
stream_filter = StreamFilter(Gate=material_2, Stream0=aluminum_2, Stream1=copper_2, Stream2=steel_2)
panel = Panel(evaluate_schema.JSON)
context_print = ContextPrint(CurrentMaterial=stream_filter)
