# Grasshopper definition table_example.gh (Grasshopper 1.0.8)

table_length_cm = Slider(100, range=100..5000)
table_width_cm = Slider(210, range=100..250)
table_length_cm_2 = Slider(2.2, range=1..6)
table_widht_cm = GetInteger(table_width_cm, AtLeast=1, AtMost=1, Maximum=2147483647, Minimum=-2147483648, TreeAccess=False)
table_length_cm_3 = GetInteger(table_length_cm, AtLeast=1, AtMost=1, Maximum=2147483647, Minimum=-2147483648, TreeAccess=False)
table_thickness_cm = GetNumber(table_length_cm_2, AtLeast=1, AtMost=1, Maximum=1.797693135e+308, Minimum=-1.797693135e+308, TreeAccess=False)

division = Division(A=table_widht_cm, B=2)
negative = Negative(Value=division)
construct_domain = ConstructDomain(DomainStart=division, DomainEnd=negative)

division_2 = Division(A=table_length_cm_3, B=2)
negative_2 = Negative(Value=division_2)
construct_domain_2 = ConstructDomain(DomainStart=division_2, DomainEnd=negative_2)

inset = Slider(10, range=0..20)
diam_start = Slider(3, range=1..3)
diam_end = Slider(2.7, range=1..3)
maximum = Maximum(A=diam_start, B=diam_end)
rectangle = Rectangle(Plane=PlaneXY(0, 0, 0), XSize=construct_domain, YSize=construct_domain_2, Radius=Slider(10, range=0..10))  # -> Rectangle, Length
rectangle_2 = Rectangle(Plane=PlaneXY(0, 0, 0), XSize=construct_domain, YSize=construct_domain_2, Radius=0)  # -> Rectangle, Length
addition = Addition(A=inset, B=maximum)
negative_3 = Negative(Value=addition)
unit_z = UnitZ(Factor=table_thickness_cm)
boundary_surfaces = BoundarySurfaces(Edges=rectangle.Rectangle)
offset_curve = OffsetCurve(Curve=rectangle_2.Rectangle, Distance=negative_3, Corners=1)
unit_z_2 = UnitZ(Factor=1)  # -> expr("x*-1", UnitVector)
explode = Explode(Curve=offset_curve, Recursive=True)  # -> Segments, Vertices
extrude = Extrude(Base=boundary_surfaces, Direction=unit_z)
panel = Panel("""0
1""")
merge = Merge(Data1=diam_start, Data2=diam_end)
line_sdl = LineSDL(Start=explode.Vertices, Direction=unit_z_2, Length=Slider(114, range=90..135))
pipe_variable = PipeVariable(Curve=line_sdl, Parameters=panel, Radii=merge, Caps=1, FitRail=False)
