# Grasshopper definition builder_test.gh (Grasshopper 1.0.8)
# plug-ins: Selva

types = ValueList({"Sphere": 0, "Cylinder": 1, "Box": 2}, selected="Cylinder")
radius = Slider(7, range=0..20)
heigth = Slider(10, range=10..20)
width = Slider(10, range=10..20)
ui_bridge = UIBridge(Enable=Toggle(True), Schema="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", SessionId="m0iEJ-Cv")  # -> SessionID, Info, Schema
context_print = ContextPrint(Schema=ui_bridge.Schema)
copy_up = GetBoolean("false", AtLeast=1, AtMost=1, FalseValue="False", TreeAccess=False, TrueValue="True")
radius_2 = GetNumber(radius, AtLeast=1, AtMost=1, Maximum=25, Minimum=5, TreeAccess=False)
width_2 = GetNumber(heigth, AtLeast=1, AtMost=1, Maximum=20, Minimum=5, TreeAccess=False)
heigth_2 = GetNumber(width, AtLeast=1, AtMost=1, Maximum=20, Minimum=5, TreeAccess=False)
get_value_list = GetValueList(
    types,
    AtLeast=1,
    AtMost=1,
    Immediate=True,
    StoredItems="""[
  {
    "name": "Sphere",
    "expression": "0"
  },
  {
    "name": "Cylinder",
    "expression": "1"
  },
  {
    "name": "Box",
    "expression": "2"
  }
]""",
    TreeAccess=False)
cylinder = Cylinder(Base=PlaneXY(0, 0, 0), Radius=radius_2, Length=heigth_2)
sphere = Sphere(Base=PlaneXY(0, 0, 0), Radius=radius_2)
center_box = CenterBox(Base=PlaneXY(0, 0, 0), X=radius_2, Y=width_2, Z=heigth_2)
cap_holes = CapHoles(Brep=cylinder)
stream_filter = StreamFilter(Gate=get_value_list, Stream0=sphere, Stream1=cap_holes, Stream2=center_box)
bounding_box = BoundingBox(Content=stream_filter, Plane=PlaneXY(0, 0, 0))  # -> Box, Box_2
deconstruct_box = DeconstructBox(Box=bounding_box.Box)  # -> Plane, X, Y, Z
unit_z = UnitZ(Factor=deconstruct_box.Z)
move = Move(Geometry=stream_filter, Motion=unit_z)  # -> Geometry, Transform
merge = Merge(Data1=stream_filter, Data2=move.Geometry)  # -> flatten(Result)
stream_filter_2 = StreamFilter(Gate=copy_up, Stream0=stream_filter, Stream1=merge)
mesh = Mesh(<mesh referenced from the Rhino model>)
mesh_2 = Mesh([<mesh referenced from the Rhino model> x28])
mesh_3 = Mesh([<mesh referenced from the Rhino model> x26])
mesh_4 = Mesh([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])
number_slider = Slider(0.5, range=0..1)
material_color = ColourSwatch(SwatchColor=RGB(199, 165, 165))
area = Area(Geometry=mesh_4)  # -> Area, Centroid
three_material = ThreeMaterial(Color=material_color, Metalness="0.95", Roughness="0.25", Opacity=1, Transparent=False)
mesh_brep = MeshBrep(
    Brep=stream_filter_2,
    Settings={GridMaxCount=0, GridMinCount=16, JaggedSeams=False, MaxEdgeLength=0, MinEdgeLength=0.0001, MinTolerance=0, Refine=True, RefineAngle=0, RelativeTolerance=0.65, SimplePlanes=True, Tolerance=0})
geometry_to_file = GeometryToFile(Geometry=stream_filter_2, FileNames="Test", FileEnding=".3dm")
area_2 = Area(Geometry=stream_filter_2)  # -> Area, Centroid
scale_nu = ScaleNU(Geometry=mesh_brep, Plane=PlaneXY(0, 0, 0), ScaleX=Slider(0.5, range=0..1), ScaleY=Slider(0.9, range=0..1), ScaleZ=1)  # -> Geometry, Transform
material_color_2 = ColourSwatch(SwatchColor=RGB(97, 96, 83))
bake = ContextBake(Content=geometry_to_file)
print = ContextPrint(Print=area_2.Area)
unit_x = UnitX(Factor=1)
three_material_2 = ThreeMaterial(Color=material_color_2, Metalness="0.95", Roughness="0.48", Opacity=1, Transparent=False)
linear_array = LinearArray(Geometry=scale_nu.Geometry, Direction=unit_x, Count=10)  # -> flatten(Geometry), Transform
display = Display(Geo=mesh_4, ThreeMaterial=three_material_2)
display_2 = ContextBake(Content=display)
