# Grasshopper definition builder_test.gh (Grasshopper 1.0.8)
# plug-ins: ComputeBuilder, Compuceraptor

get_boolean = GetBoolean(Toggle(False), AtLeast=1, AtMost=1, FalseValue="False", TreeAccess=False, TrueValue="True")
num_nu = GetNumber(Slider(15, range=0..20), AtLeast=1, AtMost=1, Maximum=50, Minimum=20, TreeAccess=False)
get_string = GetString("fgdffgdfg", AtLeast=1, AtMost=1, TreeAccess=False)
neu = GetNumber(Slider(10, range=0..10), AtLeast=1, AtMost=1, Maximum=1.797693135e+308, Minimum=-1.797693135e+308, TreeAccess=False)
value_list = ValueList({"One": 1, "Two": 2, "Three": 2² - 1, "Four": Sqrt(16)}, selected="One")
panel = Panel(get_boolean)
construct_point = ConstructPoint(XCoordinate=Slider(65, range=0..100), YCoordinate=0, ZCoordinate=0)
construct_point_2 = ConstructPoint(XCoordinate=0, YCoordinate=num_nu, ZCoordinate=num_nu)
ui_builder = UIBuilder(
    Enable=Toggle(True),
    Refresh=Button(),
    OpenPreview=Button(),
    Schema="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",
    SessionId="9eeafcd4",
    Values="{\"7725509f-7a4a-4e24-8979-eba08052c695\":false,\"64670d2f-632b-44eb-b04e-661ee33e477e\":10,\"12e4b4b9-2767-426b-baa5-0a0e1bcd0a5b\":88.1}")  # -> SessionID, Info, Schema
panel_2 = Panel(num_nu)
valuelist = GetValueList(
    value_list,
    DefaultSelectedIndex=0,
    StoredItems="""[
  {
    "name": "One",
    "expression": "1"
  },
  {
    "name": "Two",
    "expression": "2"
  },
  {
    "name": "Three",
    "expression": "2² - 1"
  },
  {
    "name": "Four",
    "expression": "Sqrt(16)"
  }
]""")
box_2pt = Box2Pt(PointA=construct_point, PointB=construct_point_2, Plane=PlaneXY(0, 0, 0))
clear_context_data = ClearContextData(Clear=Button())
panel_3 = Panel(get_string)
number = Number(num_nu)
addition = Addition(A=number, B=Slider(100, range=0..1000))
display = Display(Geo=box_2pt)
schema = ContextPrint(Schema=ui_builder.Schema)
context_print = ContextPrint(Text=addition)
context_bake = ContextBake(Content=display)
